# Grasshopper definition Woody.gh (Grasshopper 1.0.7)
# plug-ins: Human, treesloth01, froGH, Pufferfish, EleFront, Telepathy, MetaHopper, Imaging Library, ToggleV6, Wombat, ClipperComponents

panel = Panel("""MDF
Corian
Plywood
Polypropilen
Aluminum""")
panel_2 = Panel("""4
5
6
8
10
12
12.3
16
18
19
22
25
27
32
40
58""")
valuelist_name = Panel("Material")
valuelist_name_2 = Panel("MatThickness")
pvl = PopulateValueList(Name=valuelist_name, Keys=panel, Values=panel)  # inputs Keys: list, Values: list
# ---------- pvl: Python ----------
"""
Populate Value List
    Inputs:
        Name: {item,str}
        Keys: {list,str}
        Values: {list,str}
    Outputs:
    Remarks:
        Author: Anders Holden Deleuran (BIG IDEAS)
        Rhino: 6.30.20266.14531
        Version: 210108
"""

ghenv.Component.Name = "PopulateValueList"
ghenv.Component.NickName = "PVL"

import Grasshopper as gh

if Keys and Values:
    for obj in ghenv.Component.OnPingDocument().Objects:
        if type(obj) is gh.Kernel.Special.GH_ValueList:
            if obj.NickName == Name:
                if obj.ListItems.Count:
                    selected = obj.FirstSelectedItem.Name
                else:
                    selected = None
                obj.ListItems.Clear()
                for k,v in zip(Keys,Values):
                    vli = gh.Kernel.Special.GH_ValueListItem(str(k),str('"' + v + '"'))
                    obj.ListItems.Add(vli)
                if selected in Keys:
                    obj.SelectItem(Keys.index(selected))
                obj.ExpireSolution(True)
# ---------- end pvl ----------
pvl_2 = PopulateValueList(Name=valuelist_name_2, Keys=panel_2, Values=panel_2)  # inputs Keys: list, Values: list; same code as pvl
matthickness = ValueList({"4", "5", "6", "8", "10", "12", "12.3", "16", "18", "19", "22", "25", "27", "32", "40", "58"}, selected="12.3")
matthickness_2 = ValueList({"4", "5", "6", "8", "10", "12", "12.3", "16", "18", "19", "22", "25", "27", "32", "40", "58"}, selected="10")
matthickness_3 = ValueList({"4", "5", "6", "8", "10", "12", "12.3", "16", "18", "19", "22", "25", "27", "32", "40", "58"}, selected="16")
matthickness_4 = ValueList({"4", "5", "6", "8", "10", "12", "12.3", "16", "18", "19", "22", "25", "27", "32", "40", "58"}, selected="19")
matthickness_5 = ValueList({"4", "5", "6", "8", "10", "12", "12.3", "16", "18", "19", "22", "25", "27", "32", "40", "58"}, selected="22")
matthickness_6 = ValueList({"4", "5", "6", "8", "10", "12", "12.3", "16", "18", "19", "22", "25", "27", "32", "40", "58"}, selected="25")
matthickness_7 = ValueList({"4", "5", "6", "8", "10", "12", "12.3", "16", "18", "19", "22", "25", "27", "32", "40", "58"}, selected="40")
matthickness_8 = ValueList({"4", "5", "6", "8", "10", "12", "12.3", "16", "18", "19", "22", "25", "27", "32", "40", "58"}, selected="27")
matthickness_9 = ValueList({"4", "5", "6", "8", "10", "12", "12.3", "16", "18", "19", "22", "25", "27", "32", "40", "58"}, selected="8")
material = ValueList({"MDF", "Corian", "Plywood", "Polypropilen", "Aluminum"}, selected="Corian")
material_2 = ValueList({"MDF", "Corian", "Plywood", "Polypropilen", "Aluminum"}, selected="MDF")
material_3 = ValueList({"MDF", "Corian", "Plywood", "Polypropilen", "Aluminum"}, selected="MDF")
material_4 = ValueList({"MDF", "Corian", "Plywood", "Polypropilen", "Aluminum"}, selected="MDF")
material_5 = ValueList({"MDF", "Corian", "Plywood", "Polypropilen", "Aluminum"}, selected="MDF")
material_6 = ValueList({"MDF", "Corian", "Plywood", "Polypropilen", "Aluminum"}, selected="MDF")
material_7 = ValueList({"MDF", "Corian", "Plywood", "Polypropilen", "Aluminum"}, selected="Plywood")
material_8 = ValueList({"MDF", "Corian", "Plywood", "Polypropilen", "Aluminum"}, selected="Plywood")
material_9 = ValueList({"MDF", "Corian", "Plywood", "Polypropilen", "Aluminum"}, selected="Polypropilen")
material_10 = ValueList({"MDF", "Corian", "Plywood", "Polypropilen", "Aluminum"}, selected="Aluminum")
matthickness_10 = ValueList({"4", "5", "6", "8", "10", "12", "12.3", "16", "18", "19", "22", "25", "27", "32", "40", "58"}, selected="58")
mat_width = Slider(760, range=0..10000)
mat_width_2 = Slider(2010, range=0..10000)
mat_width_3 = Slider(2010, range=0..10000)
mat_width_4 = Slider(2010, range=0..10000)
mat_width_5 = Slider(2010, range=0..10000)
mat_width_6 = Slider(2010, range=0..10000)
mat_width_7 = Slider(1220, range=0..10000)
mat_width_8 = Slider(1220, range=0..10000)
mat_width_9 = Slider(1500, range=0..10000)
mat_height = Slider(3680, range=0..10000)
mat_height_2 = Slider(2780, range=0..10000)
mat_height_3 = Slider(2780, range=0..10000)
mat_height_4 = Slider(2780, range=0..10000)
mat_height_5 = Slider(2780, range=0..10000)
mat_height_6 = Slider(2780, range=0..10000)
mat_height_7 = Slider(2440, range=0..10000)
mat_height_8 = Slider(2440, range=0..10000)
mat_height_9 = Slider(3000, range=0..10000)
mat_height_10 = Slider(3000, range=0..10000)
mat_width_10 = Slider(150, range=0..10000)
format = Format(Format="{0} {1}x{2}x{3}", Culture=127, Data0=material, Data1=matthickness, Data2=mat_height, Data3=mat_width)
format_2 = Format(Format="{0} {1}x{2}x{3}", Culture=127, Data0=material_2, Data1=matthickness_2, Data2=mat_height_2, Data3=mat_width_2)
format_3 = Format(Format="{0} {1}x{2}x{3}", Culture=127, Data0=material_3, Data1=matthickness_3, Data2=mat_height_3, Data3=mat_width_3)
format_4 = Format(Format="{0} {1}x{2}x{3}", Culture=127, Data0=material_4, Data1=matthickness_4, Data2=mat_height_4, Data3=mat_width_4)
format_5 = Format(Format="{0} {1}x{2}x{3}", Culture=127, Data0=material_5, Data1=matthickness_5, Data2=mat_height_5, Data3=mat_width_5)
format_6 = Format(Format="{0} {1}x{2}x{3}", Culture=127, Data0=material_6, Data1=matthickness_6, Data2=mat_height_6, Data3=mat_width_6)
format_7 = Format(Format="{0} {1}x{2}x{3}", Culture=127, Data0=material_7, Data1=matthickness_7, Data2=mat_height_7, Data3=mat_width_7)
format_8 = Format(Format="{0} {1}x{2}x{3}", Culture=127, Data0=material_8, Data1=matthickness_8, Data2=mat_height_8, Data3=mat_width_8)
format_9 = Format(Format="{0} {1}x{2}x{3}", Culture=127, Data0=material_9, Data1=matthickness_9, Data2=mat_height_9, Data3=mat_width_9)
format_10 = Format(Format="{0} {1}x{2}x{3}", Culture=127, Data0=material_10, Data1=matthickness_10, Data2=mat_height_10, Data3=mat_width_10)
merge = Merge(Data1=format, Data2=matthickness, Data3=mat_height, Data4=mat_width)
merge_2 = Merge(Data1=format_2, Data2=matthickness_2, Data3=mat_height_2, Data4=mat_width_2)
merge_3 = Merge(Data1=format_3, Data2=matthickness_3, Data3=mat_height_3, Data4=mat_width_3)
merge_4 = Merge(Data1=format_4, Data2=matthickness_4, Data3=mat_height_4, Data4=mat_width_4)
merge_5 = Merge(Data1=format_5, Data2=matthickness_5, Data3=mat_height_5, Data4=mat_width_5)
merge_6 = Merge(Data1=format_6, Data2=matthickness_6, Data3=mat_height_6, Data4=mat_width_6)
merge_7 = Merge(Data1=format_7, Data2=matthickness_7, Data3=mat_height_7, Data4=mat_width_7)
merge_8 = Merge(Data1=format_8, Data2=matthickness_8, Data3=mat_height_8, Data4=mat_width_8)
merge_9 = Merge(Data1=format_9, Data2=matthickness_9, Data3=mat_height_9, Data4=mat_width_9)
merge_10 = Merge(Data1=format_10, Data2=matthickness_10, Data3=mat_height_10, Data4=mat_width_10)
entwine = Entwine(
    Branch0X=merge,
    Branch1X=merge_2,
    Branch2X=merge_3,
    Branch3X=merge_4,
    Branch4X=merge_5,
    Branch5X=merge_6,
    Branch6X=merge_8,
    Branch7X=merge_9,
    Branch8X=merge_10,
    Branch9X=merge_7,
    FlattenInputs=False)  # -> simplify(Result)
item = ListItem(List=entwine, Index=0, Wrap=True)  # -> flatten(Item)
tstat = TreeStatistics(Tree=entwine)  # -> Paths, Length, Count
tsort = SortText(Keys=item, Values=tstat.Paths, Culture=127)  # -> Keys, Values
branch = TreeBranch(Tree=entwine, Path=tsort.Values, MaintainPaths=False)

list = ItemSelector(
    tsort.Keys,
    {"Aluminum 58x3000x150", "Corian 12.3x3680x760", "MDF 10x2780x2010", "MDF 16x2780x2010", "MDF 19x2780x2010", "MDF 22x2780x2010", "MDF 25x2780x2010", "Plywood 27x2440x1220", "Plywood 40x2440x1220", "Polypropilen 8x3000x1500"}, selected="MDF 16x2780x2010")
z0 = Slider(0, range=0..51)
clearance_plane = Slider(3, range=1..40)

mindex = MemberIndex(Set=tsort.Keys, Member=list)  # -> Index, Count
path = ConstructPath(Indices=mindex.Index)
branch_2 = TreeBranch(Tree=branch, Path=path, MaintainPaths=True)
item_2 = ListItem(List=branch_2, Index=0, Wrap=True)  # -> Item, Item1, Item2, Item3
split = TextSplit(Text=item_2.Item, Separators=" ")
item_3 = ListItem(List=split, Index=0, Wrap=True)
flatten = FlattenTree(Tree=item_2.Item1, Path="{0}")
concat = Concatenate(FragmentA=item_2.Item1, FragmentB=item_3)

z0_2 = ValueList({"Top Of Material": 0, "Bottom Of Material": 1, "Custom": 2}, selected="Top Of Material")
z0_top_bottom = StreamFilter(Gate=z0_2, Stream0=[z0, z0_2], Stream1=[flatten, z0_2], Stream2=[z0, z0_2])

# ---- group: LCS
wcs = Point()

# ---- group: Sheets
sheet = Curve()

# ---- group: Save GH Project
filename_custom = BooleanToggle(False)
read_filename = Button()
python = GhPythonScript(x=read_filename)  # -> rhFile, rhFolder, ghFile
# ---------- python: Python ----------
import Rhino
import os

if Rhino.RhinoDoc.ActiveDoc.Path:
    rhFile = Rhino.RhinoDoc.ActiveDoc.Name[:-4]
    rhFolder = Rhino.RhinoDoc.ActiveDoc.Path.rpartition("\\")[0]    
ghfullpath = ghdoc.Path
if ghfullpath:
    ghFile = os.path.basename(ghfullpath)[:-3]
else:
    ghFile = None
# ---------- end python ----------
panel_3 = Panel(python.rhFile)
save_gh_file = Button()
number_slider = Slider(1, range=0..50)
filter = StreamFilter(Gate=filename_custom, Stream0=python.rhFile, Stream1="Номер заказа")
format_11 = Format(Format="\{2}. {0}-{1}", Culture=127, Data0=concat, Data1=number_slider, Data2=filter)
len = TextLength(Text=number_slider)  # -> expr("x+1", Length)
len_2 = TextLength(Text=format_11)
equals = Equality(FirstNumber=number_slider, SecondNumber=0)  # -> Equality, Inequality
subtraction = Subtraction(A=len_2, B=len)
addition = Addition(A=len, B=Slider(2, range=0..100))
fragment = TextFragment(Text=format_11, Start=0, Count=subtraction)
concat_2 = Concatenate(FragmentA="\", FragmentB=fragment)
filter_2 = StreamFilter(Gate=equals.Equality, Stream0=format_11, Stream1=concat_2)
f_ghsave = SaveGHFile(FilePath=python.rhFolder, FileName=filter_2, SaveTrigger=save_gh_file)  # -> SavedFilePath, SavedFileStatus

# ----
pipeline = GeometryPipeline(
    GroupByLayer=False,
    GroupByType=False,
    IncludeHidden=True,
    IncludeLocked=True,
    LayerFilter="*",
    NameFilter="*",
    SublayerFiltering=True,
    TypeFilter=4)
null = NullItem(Item=wcs)  # -> NullFlags, InvalidFlags, Description
path_2 = ConstructPath(Indices=graft(Slider(7, range=0..30)))  # -> flatten(Branch)

sort_geometry = ValueList({"None": 0, "Bottom to Top": 1, "Top to Bottom": 2, "Left to Right": 3, "Right to Left": 4, "Minimum distance": 5, "By Selection": 6}, selected="Minimum distance")
geometry_control_point = ValueList({"Curve Seam": 4, "Lower Left": 0, "Lower Right": 1, "Upper Right": 2, "Upper Left": 3}, selected="Curve Seam")

nested_geometry = BooleanToggle(True)
bit_position = ValueList({"Outside curve": 0, "Inside curve": 1, "Along curve": 2}, selected="Outside curve")
corners = ValueList({"Sharp": 1, "Round": 2, "Dog-Bone": 3}, selected="Round")

cut_levels_order = ValueList({"Depth": 0, "Level": 1}, selected="Depth")
cut_direction = ValueList({"Climb (Down cut)": 0, "Conventional (Up cut)": 1, "Mixed": 2}, selected="Conventional (Up cut)")
step_z_cut = Slider(10, range=1..100)
cut_feed_mm_min = Slider(3600, range=100..12000)
engage_feed_mm_min = Slider(2000, range=100..12000)
offset = Slider(0, range=-50..50)
plunge_feed_mm_min = Slider(2000, range=100..12000)

entry = ValueList({"None": 0, "Along Path": 1, "Zig-Zag": 2}, selected="Along Path")
path_length = Slider(30, range=0..100)

unweave = Unweave(List=z0_top_bottom, UnweavePattern=[0, 1])  # -> Data0, Data1
addition_2 = Addition(A=clearance_plane, B=unweave.Data0)
z0_3 = Panel(unweave.Data0)

start_selection = BooleanToggle(False)
reset_selection = Button()

start_depth = Slider(0, range=-100..100)
end_depth = Slider(12.3, range=0..100)
finish_depth = Slider(0, range=0..100)

dom = ConstructDomain(DomainStart=0, DomainEnd=item_2.Item1)
remap = RemapNumbers(Value=unweave.Data0, Source=dom, Target=item_2.Item1)  # -> Mapped, Clipped
Z = UnitZ(Factor=remap.Clipped)
panel_4 = Panel(remap.Clipped)

d2 = RemoteReceiver()
d3 = RemoteReceiver()
d4 = RemoteReceiver()
d5 = RemoteReceiver()
d6 = RemoteReceiver()
d7 = RemoteReceiver()
d8 = RemoteReceiver()
d9 = RemoteReceiver()
d10 = RemoteReceiver()
d11 = RemoteReceiver()
d12 = RemoteReceiver()
d13 = RemoteReceiver()

pl = ConstructPlane(Origin=wcs, XAxis=Vector(1, 0, 0), YAxis=Vector(0, 1, 0))
rectangle = Rectangle(Plane=pl, XSize=item_2.Item3, YSize=item_2.Item2, Radius=0)  # -> Rectangle, Length
null_2 = NullItem(Item=sheet)  # -> NullFlags, InvalidFlags, Description
pdecon = Deconstruct(Point=wcs)  # -> XComponent, YComponent, ZComponent

ma = MassAddition(Input=null_2.NullFlags)  # -> Result, PartialResults

filter_3 = StreamFilter(Gate=ma.Result, Stream0=sheet, Stream1=rectangle.Rectangle)

swatch = ColourSwatch(SwatchColor=RGB(112, 47, 47))
symadv = SymbolAdvanced(
    Style=6,
    SizePrimary=Slider(5, range=0..100),
    SizeSecondary=10,
    Rotation=0,
    Fill=ColourSwatch(SwatchColor=RGB(153, 0, 0)),
    Edge=swatch,
    Width=2,
    Adjust=False)
symbol = SymbolDisplay(Location=wcs, Display=symadv)
previewlw = CustomPreviewLineweights(Geometry=filter_3, Shader=swatch, Thickness=Slider(3, range=0..10), Absolute=False)

cluster = Cluster_16(L=pipeline, C=filter_3, relay=item_2.Item1)  # -> T, T_2, T_3

# ---- group: BBox
bbox = GhPythonScript(object=filter_3)  # -> out, box, X, Y, Max, Min, Rect; inputs object: list; same code as bbox

# ----
area = Area(Geometry=bbox.Rect)  # -> Area, Centroid

filter_4 = StreamFilter(Gate=null.NullFlags, Stream0=cluster.T)
geoattributes = GhPythonScript(G=filter_4)  # -> out, FL, L, C, GFL, GL, GC, GF; inputs G: list of Guid, F: Boolean; same code as geoattributes

# ---- group: Plug-Ins Used
docinfo = DocumentInfo(AutoUpdate=False, Recursive=invert(False))  # -> DocumentName, DocumentFilePath, Components, Params, _3rdPartyAssemblies

# ----
txt = Text(docinfo.Components)
split_2 = TextSplit(Text=txt, Separators=".")
tsort_2 = SortText(Keys=txt, Values=docinfo.Components, Culture=127)  # -> Keys, Values
item_4 = ListItem(List=split_2, Index=0, Wrap=True)  # -> flatten(Item)
graft = GraftTree(Tree=tsort_2.Values, IncludeEmptyLists=True, IncludeNullItems=True)
txt_2 = Text(tsort_2.Keys)
tmatch = MatchText(Text=item_4, Pattern=graft(["*Component*", "Grasshopper*", "GhPython*", "LinearXForms"]), Case=True)
cset = CreateSet(List=txt_2)  # -> Set, Map
flip = FlipMatrix(Data=tmatch)
split_3 = TextSplit(Text=cset.Set, Separators=".")
ma_2 = MassAddition(Input=flip)  # -> flatten(Result), PartialResults
item_5 = ListItem(List=split_3, Index=0, Wrap=True)  # -> flatten(Item)
dispatch = Dispatch(List=docinfo.Components, DispatchPattern=ma_2.Result)  # -> ListA, ListB
cset_2 = CreateSet(List=item_5)  # -> Set, Map
txt_3 = Text(dispatch.ListB)
tmatch_2 = MatchText(Text=cset_2.Set, Pattern="*Component*", Case=True)
tsort_3 = SortText(Keys=txt_3, Values=dispatch.ListB, Culture=127)  # -> Keys, Values
dispatch_2 = Dispatch(List=cset_2.Set, DispatchPattern=tmatch_2)  # -> ListA, ListB
cset_3 = CreateSet(List=tsort_3.Keys)  # -> Set, Map
graft_2 = GraftTree(Tree=tsort_3.Values, IncludeEmptyLists=True, IncludeNullItems=True)
tsort_4 = SortText(Keys=dispatch_2.ListB, Culture=127)  # -> Keys, Values
path_3 = ConstructPath(Indices=graft(cset_3.Map))  # -> flatten(Branch)
tstat_2 = TreeStatistics(Tree=graft_2)  # -> Paths, Length, Count

# ---- group: Plug-Ins Used (continued)
panel_5 = Panel(tsort_4.Keys)

# ----
replace = ReplacePaths(Data=graft_2, Search=tstat_2.Paths, Replace=path_3)
panel_6 = Panel(replace)
branch_3 = TreeBranch(Tree=replace, Path=path_2, MaintainPaths=True)
hilite = HighlightObjects(ObjectsToHighlight=branch_3, HighlightColor=RGB(127, 255, 212), Activate=Toggle(False))

# ----
# 1
# D4H20_14MM_VB
layers = ValueList({"Default", "D10_10MM_VB", "D4_13MM_VB": "ОТВ-ЛИЦ::D4_13MM_VB", "D4H20_14MM_VB": "ОТВ-ЛИЦ::D4H20_14MM_VB", "OBG_16MM_SN": "OBG_SN::OBG_16MM_SN"}, selected="Default")
valuelist_name_3 = Panel("Layers")
pvl_3 = PopulateValueList(Name=valuelist_name_3, Keys=cluster.T_2, Values=cluster.T_3)  # inputs Keys: list, Values: list; same code as pvl
tmatch_3 = MatchText(Text=layers, Pattern="Default", Case=True)
cull = CullPattern(List=layers, CullPattern=invert(tmatch_3))
bit_dia = Slider(10, range=0..80)
ma_3 = MassAddition(Input=offset)  # -> Result, PartialResults
larger = LargerThan(FirstNumber=finish_depth, SecondNumber=0)  # -> LargerThan, OrEqualTo
offset_2 = Slider(80, range=0..100)
clean_islands = BooleanToggle(True)
list_2 = ValueList({"Round": 0, "Square": 1, "Miter": 2}, selected="Round")
list_3 = ValueList({"Round": 0, "Square": 1, "Miter": 2}, selected="Round")
Z_2 = UnitZ(Factor=1)
neg = Negative(Value=Z_2)
number_slider_2 = Slider(400, range=0..1000)
knob = ControlKnob(Decimals=0, Limit=True, Maximum=11, Minimum=1, Range=10, Value=1)
concat_3 = Concatenate(FragmentA=knob, FragmentC="-", FragmentB=Slider(1, range=1..10))
start_code = STARTCODE()
end_code = ENDCODE()
setscribble = SetScribbleProperties(Scribble="Grasshopper.Kernel.Types.GH_ObjectWrapper", ScribbleText=knob, ScribbleSize=number_slider_2)
addition_3 = Addition(A=unweave.Data1, B=1)
save = Toggle(SpecialInteger=True)
open_folder = Button()
toolpath_streaming_folder = FilePath("E:\Работа\Simple CNC Post TEST\")
concat_4 = Concatenate(FragmentA="D", FragmentB=knob)

panel_7 = Panel(layers)
geoattributes_2 = GhPythonScript(G=filter_4, LF=cull, F=Toggle(True))  # -> out, FL, L, C, GFL, GL, GC, GF; inputs G: list of Guid, F: Boolean; same code as geoattributes

ghpython_script = GhPythonScript(ln=geoattributes_2.GL)  # -> out, bit, start_depth, end_depth, operation, sorting, remachining; same code as ghpython_script
expression = Expression(x=ghpython_script.sorting, Expression="if(x=3,1,if(x=4,0,if(x=2,1,if(x=1,3,4))))")
python_2 = GhPythonScript(bit=ghpython_script.bit)  # -> out, bit_dia, bit_h, bit_angle
# ---------- python_2: Python ----------
__author__ = "Saha"
__version__ = "2023.03.02"

import rhinoscriptsyntax as rs
import re

if bit:
    regex = re.compile("([A-Z]*[0-9]*)")
    groups = re.split(regex, bit)
    bit_params = {g[0]: g[1:] for g in groups if g}
    bit_types = ["D", "U", "V", "F", "IN", "T"]
    for bit_type in bit_types:
        if bit_type in bit_params:
            bit_dia = bit_params[bit_type]
            break
    
    #bit_dia = bit_params.get("D", bit_params.get("U", bit_params.get("V", bit_params.get("F", bit_params.get("IN")))))
    bit_angle = bit_params.get("V")
    bit_h = bit_params.get("H")
# ---------- end python_2 ----------
expression_2 = Expression(x=ghpython_script.sorting, Expression="if(x=3,0,1)")
null_3 = NullItem(Item=ghpython_script.bit)  # -> NullFlags, InvalidFlags, Description
null_4 = NullItem(Item=python_2.bit_dia)  # -> NullFlags, InvalidFlags, Description
null_5 = NullItem(Item=ghpython_script.start_depth)  # -> NullFlags, InvalidFlags, Description
null_6 = NullItem(Item=ghpython_script.end_depth)  # -> NullFlags, InvalidFlags, Description
null_7 = NullItem(Item=ghpython_script.end_depth)  # -> NullFlags, InvalidFlags, Description
null_8 = NullItem(Item=ghpython_script.sorting)  # -> NullFlags, InvalidFlags, Description
filter_5 = StreamFilter(Gate=null_4.NullFlags, Stream0=python_2.bit_dia, Stream1=bit_dia)
filter_6 = StreamFilter(Gate=null_3.NullFlags, Stream0=ghpython_script.bit, Stream1=filter_5)
filter_7 = StreamFilter(Gate=null_5.NullFlags, Stream0=ghpython_script.start_depth, Stream1=start_depth)
filter_8 = StreamFilter(Gate=null_6.NullFlags, Stream0=ghpython_script.end_depth, Stream1=end_depth)
filter_9 = StreamFilter(Gate=null_7.NullFlags, Stream0=ghpython_script.operation, Stream1=bit_position)
filter_10 = StreamFilter(Gate=null_8.NullFlags, Stream0=ghpython_script.sorting, Stream1=sort_geometry)
filter_11 = StreamFilter(Gate=null_8.NullFlags, Stream0=expression, Stream1=geometry_control_point)
filter_12 = StreamFilter(Gate=null_8.NullFlags, Stream0=expression_2, Stream1=cut_direction)
larger_2 = LargerThan(FirstNumber=filter_8, SecondNumber=item_2.Item1)  # -> LargerThan, OrEqualTo
filter_13 = StreamFilter(Gate=larger_2.OrEqualTo, Stream0=filter_8, Stream1=item_2.Item1)
tmatch_4 = MatchText(Text=filter_6, RegEx="OBG", Case=True)
concat_5 = Concatenate(FragmentA="D", FragmentB=filter_5)
filter_14 = StreamFilter(Gate=tmatch_4, Stream0=filter_6, Stream1=concat_5)
subtraction_2 = Subtraction(A=filter_13, B=filter_7)
subtraction_3 = Subtraction(A=subtraction_2, B=finish_depth)
rep = ReplaceText(Text=geoattributes_2.GL, Find="OBG", Replace=filter_14, RecursiveReplace=False)
division = Division(A=subtraction_3, B=step_z_cut)
round = Round(Number=division)  # -> Nearest, Floor, Ceiling
division_2 = Division(A=subtraction_3, B=round.Ceiling)
stack = StackData(Data=division_2, Stack=round.Ceiling)
ma_4 = MassAddition(Input=stack)  # -> Result, PartialResults
addition_4 = Addition(A=filter_7, B=ma_4.PartialResults)
lng = ListLength(List=addition_4)
ins = InsertItems(List=stack, Item=finish_depth, Indices=lng, Wrap=True)
lng_2 = ListLength(List=addition_4)
ins_2 = InsertItems(List=addition_4, Item=filter_8, Indices=lng_2, Wrap=True)
filter_15 = StreamFilter(Gate=larger.LargerThan, Stream0=addition_4, Stream1=ins_2)
filter_16 = StreamFilter(Gate=larger.LargerThan, Stream0=stack, Stream1=ins)
panel_8 = Panel(filter_16)
panel_9 = Panel(filter_15)
offset_3 = Evaluate(F="(x/100)*y", x=filter_5, y=offset_2)
division_3 = Division(A=filter_5, B=2)
txt_4 = Text(filter_14)
format_12 = Format(Format="{0}.{1}-{2}", Culture=127, Data0=knob, Data1=txt_4, Data2=addition_3)
panel_10 = Panel(format_12)

cluster_2 = Cluster_4(T=filter_5)
split_4 = TextSplit(Text=rep, Separators="::")
item_6 = ListItem(List=split_4, Index=0, Wrap=True)  # -> Item1, Item
txt_5 = Text(item_6.Item1)

division_4 = Division(A=cluster_2, B=2)
ma_5 = MassAddition(Input=[offset, division_4])  # -> Result, PartialResults
neg_2 = Negative(Value=ma_5.Result)
filter_17 = StreamFilter(Gate=filter_9, Stream0=neg_2, Stream1=neg_2, Stream2=offset, Stream3=neg_2, Stream5=0)
setscribble_2 = SetScribbleProperties(Scribble="Grasshopper.Kernel.Types.GH_ObjectWrapper", ScribbleText=item_6.Item1, ScribbleSize=number_slider_2)

crv = Curve(geoattributes_2.GF)
cluster_3 = Cluster_15(crv=crv, relay=nested_geometry, A=filter_9)  # -> outside, inside, open
cir = Circle(Plane=PlaneXY(0, 0, 0), Radius=1)
cir_2 = Circle(Plane=PlaneXY(0, 0, 0), Radius=1)
cir_3 = Circle(Plane=PlaneXY(0, 0, 0), Radius=1)
flip_2 = FlipCurve(Curve=cir)  # -> Curve, Flag
flip_3 = FlipCurve(Curve=cir_2)  # -> Curve, Flag
flip_4 = FlipCurve(Curve=cir_3)  # -> Curve, Flag
filter_18 = StreamFilter(Gate=filter_9, Stream0=flip_3.Curve, Stream1=cir_2, Stream3=cir_2, Stream5=cir_2, Stream6=cir_2)
filter_19 = StreamFilter(Gate=filter_9, Stream0=cir_3, Stream1=flip_4.Curve, Stream3=flip_4.Curve, Stream5=flip_4.Curve, Stream6=flip_4.Curve)
filter_20 = StreamFilter(Gate=filter_9, Stream0=flip_2.Curve, Stream1=cir, Stream3=cir, Stream5=cir, Stream6=cir)
flip_5 = FlipCurve(Curve=cluster_3.outside, Guide=graft(filter_18))  # -> Curve, Flag
flip_6 = FlipCurve(Curve=cluster_3.inside, Guide=graft(filter_19))  # -> Curve, Flag
flip_7 = FlipCurve(Curve=cluster_3.open, Guide=graft(filter_20))  # -> Curve, Flag
change_curve_seam = ChangeCurveSeam(G=filter_11, crv=flip_5.Curve, crv_2=geoattributes_2.GF)  # -> simplify(crv_5)
change_curve_seam_2 = ChangeCurveSeam(G=filter_11, crv=flip_6.Curve, crv_2=geoattributes_2.GF)  # -> simplify(crv_5)
offset_4 = Offset(Curve=change_curve_seam, Distance=filter_17, Plane=PlaneXY(0, 0, 0), Corners=corners)
offset_5 = Offset(Curve=change_curve_seam_2, Distance=filter_17, Plane=PlaneXY(0, 0, 0), Corners=corners)
gate = StreamGate(Stream=offset_4, Gate=filter_9)  # -> Target0, Target1, Target2, Target3, Target4, Target5, Target6
gate_2 = StreamGate(Stream=offset_5, Gate=filter_9)  # -> Target0, Target1, Target2, Target3, Target4, Target5, Target6

offset_6 = Offset(Curve=flip_7.Curve, Distance=filter_17, Plane=PlaneXY(0, 0, 0), Corners=corners)
merge_11 = Merge(Data1=change_curve_seam, Data2=change_curve_seam_2)
gate_3 = StreamGate(Stream=offset_6, Gate=filter_9)  # -> Target0, Target1, Target2, Target3, Target4, Target5, Target6
area_2 = Area(Geometry=[gate_2.Target5, gate.Target5])  # -> Area, Centroid
entwine_2 = Entwine(Branch0X=gate.Target2, Branch1X=gate_2.Target2, Branch2X=gate_3.Target2, FlattenInputs=False)
entwine_3 = Entwine(Branch0X=gate.Target0, Branch1X=gate_2.Target1, Branch2X=gate_3.Target0, FlattenInputs=False)
entwine_4 = Entwine(Branch0X=gate.Target1, Branch1X=gate_2.Target0, Branch2X=gate_3.Target1, FlattenInputs=False)
renumber = RenumberPaths(Data=entwine_2)
renumber_2 = RenumberPaths(Data=entwine_3)
renumber_3 = RenumberPaths(Data=entwine_4)
re_machining = ReMachining(A=filter_9, _1=merge_11, relay=ghpython_script.remachining, A_2=filter_5, A_3=offset_3, T=Z)  # -> T_2, S, G
pocketing = Pocketing(
    A=filter_9,
    _1=merge_11,
    T=Z,
    cf=list_2,
    of=list_3,
    cut_direction=filter_12,
    A_2=offset_3,
    clean_islands=clean_islands,
    bit_dia=division_3)  # -> S, A_3, G, crv_2, S_2
cir_4 = Circle(Plane=area_2.Centroid, Radius=division_3)
line = LineSDL(Start=area_2.Centroid, Direction=neg, Length=filter_8)
boundary = BoundarySurfaces(Edges=cir_4)
preview = CustomPreview(Geometry=boundary, Material=ColourSwatch(SwatchColor=RGBA(69, 112, 26, 100)))

flip_8 = FlipCurve(Curve=renumber_2)  # -> Curve, Flag
flip_9 = FlipCurve(Curve=renumber_3)  # -> Curve, Flag
flip_10 = FlipCurve(Curve=renumber)  # -> Curve, Flag
filter_21 = StreamFilter(Gate=filter_12, Stream0=renumber, Stream1=flip_10.Curve, Stream2=renumber)
filter_22 = StreamFilter(Gate=filter_12, Stream0=renumber_2, Stream1=flip_8.Curve, Stream2=renumber_2)
filter_23 = StreamFilter(Gate=filter_12, Stream0=renumber_3, Stream1=flip_9.Curve, Stream2=renumber_3)

prune = PruneTree(Tree=filter_21, Minimum=1, Maximum=0)
prune_2 = PruneTree(Tree=filter_22, Minimum=1, Maximum=0)
prune_3 = PruneTree(Tree=filter_23, Minimum=1, Maximum=0)

move = Move(Geometry=prune, Motion=Z)  # -> Geometry, Transform
move_2 = Move(Geometry=prune_2, Motion=Z)  # -> Geometry, Transform
move_3 = Move(Geometry=prune_3, Motion=Z)  # -> Geometry, Transform
renumber_4 = RenumberPaths(Data=prune)
renumber_5 = RenumberPaths(Data=prune_2)
renumber_6 = RenumberPaths(Data=prune_3)

number_slider_3 = Slider(12, range=0..20)
swatch_2 = ColourSwatch(SwatchColor=RGB(95, 112, 26))
swatch_3 = ColourSwatch(SwatchColor=RGB(112, 18, 122))
swatch_4 = ColourSwatch(SwatchColor=RGB(26, 76, 112))
preview_2 = CustomPreview(Geometry=move.Geometry, Material=swatch_2)
preview_3 = CustomPreview(Geometry=move_2.Geometry, Material=swatch_3)
preview_4 = CustomPreview(Geometry=move_3.Geometry, Material=swatch_4)
toggle = GroupToggle(ToggleActive=False, ToggleVisible=True)  # disabled

swatch_5 = ColourSwatch(SwatchColor=RGB(42, 86, 219))
crvdir = CurveDirectionDisplay(Curves=re_machining.G, Color=RGB(255, 0, 0), Size=number_slider_3)
preview_5 = CustomPreview(Geometry=re_machining.S, Material=swatch_5)
preview_6 = CustomPreview(Geometry=re_machining.G, Material=swatch_5)
toggle_2 = GroupToggle(ToggleActive=True, ToggleVisible=False)  # disabled

swatch_6 = ColourSwatch(SwatchColor=RGB(156, 31, 62))
crvdir_2 = CurveDirectionDisplay(Curves=pocketing.G, Color=swatch_6, Size=number_slider_3)
preview_7 = CustomPreview(Geometry=pocketing.S, Material=ColourSwatch(SwatchColor=RGBA(156, 31, 62, 100)))
preview_8 = CustomPreview(Geometry=pocketing.G, Material=swatch_6)
preview_9 = CustomPreview(Geometry=pocketing.crv_2, Material=ColourSwatch(SwatchColor=RGB(255, 157, 0)))
preview_10 = CustomPreview(Geometry=pocketing.S_2, Material=ColourSwatch(SwatchColor=RGBA(255, 157, 0, 100)))
toggle_3 = GroupToggle(ToggleActive=True, ToggleVisible=False)  # disabled

crvdir_3 = CurveDirectionDisplay(Curves=move.Geometry, Color=swatch_2, Size=number_slider_3)
crvdir_4 = CurveDirectionDisplay(Curves=move_2.Geometry, Color=swatch_3, Size=number_slider_3)
crvdir_5 = CurveDirectionDisplay(Curves=move_3.Geometry, Color=swatch_4, Size=number_slider_3)
previewlw_2 = CustomPreviewLineweights(Geometry=prune, Shader=swatch_2, Thickness=[filter_5, filter_5], Absolute=invert(False))
previewlw_3 = CustomPreviewLineweights(Geometry=prune_2, Shader=swatch_3, Thickness=filter_5, Absolute=invert(False))
previewlw_4 = CustomPreviewLineweights(Geometry=prune_3, Shader=swatch_4, Thickness=[filter_5, filter_5], Absolute=invert(False))

polyoffset = PolylineOffset(
    Polylines=prune,
    Distance=division_3,
    Plane=Plane(origin=(0, 0, 0), x=(0, 0, 0), y=(0, 0, 0)),
    Tolerance=0.001,
    ClosedFillet=0,
    OpenFillet=0,
    Miter=2)  # -> Contour, Holes
polyoffset_2 = PolylineOffset(
    Polylines=prune_2,
    Distance=division_3,
    Plane=Plane(origin=(0, 0, 0), x=(0, 0, 0), y=(0, 0, 0)),
    Tolerance=0.001,
    ClosedFillet=0,
    OpenFillet=1,
    Miter=2)  # -> Contour, Holes
polyoffset_3 = PolylineOffset(
    Polylines=prune_3,
    Distance=division_3,
    Plane=Plane(origin=(0, 0, 0), x=(0, 0, 0), y=(0, 0, 0)),
    Tolerance=0.001,
    ClosedFillet=0,
    OpenFillet=1,
    Miter=2)  # -> Contour, Holes
polyboolean = PolylineBoolean(
    A=polyoffset.Contour,
    B=polyoffset.Holes,
    BooleanType=2,
    Plane=Plane(origin=(0, 0, 0), x=(0, 0, 0), y=(0, 0, 0)),
    Tolerance=0.001,
    EvenOdd=True)
polyboolean_2 = PolylineBoolean(
    A=polyoffset_2.Contour,
    B=polyoffset_2.Holes,
    BooleanType=2,
    Plane=Plane(origin=(0, 0, 0), x=(0, 0, 0), y=(0, 0, 0)),
    Tolerance=0.001,
    EvenOdd=True)
polyboolean_3 = PolylineBoolean(
    A=polyoffset_3.Contour,
    B=polyoffset_3.Holes,
    BooleanType=2,
    Plane=Plane(origin=(0, 0, 0), x=(0, 0, 0), y=(0, 0, 0)),
    Tolerance=0.001,
    EvenOdd=True)

boundary_2 = BoundarySurfaces(Edges=polyboolean_2)
boundary_3 = BoundarySurfaces(Edges=polyboolean_3)
boundary_4 = BoundarySurfaces(Edges=polyboolean)
preview_11 = CustomPreview(Geometry=boundary_2, Material=ColourSwatch(SwatchColor=RGBA(112, 18, 122, 100)))
preview_12 = CustomPreview(Geometry=boundary_3, Material=ColourSwatch(SwatchColor=RGBA(26, 76, 112, 100)))
preview_13 = CustomPreview(Geometry=boundary_4, Material=ColourSwatch(SwatchColor=RGBA(95, 112, 26, 100)))
toggle_4 = GroupToggle(ToggleActive=True, ToggleVisible=False)  # disabled

crv_2 = Curve([renumber_4, renumber_5, renumber_6])
cluster_4 = Cluster_5(C=move_2.Geometry, cf=swatch_3, ce=swatch_3)  # -> P, D
simplify = SimplifyCurve(Curve=reparameterize(crv_2))  # -> Curve, Simplified
symbol_2 = SymbolDisplay(Location=cluster_4.P, Display=cluster_4.D)
sorted_inside_and_outside_curves = Curve(simplify.Curve)
filter_24 = StreamFilter(
    Gate=filter_9,
    Stream0=sorted_inside_and_outside_curves,
    Stream1=sorted_inside_and_outside_curves,
    Stream2=sorted_inside_and_outside_curves,
    Stream3=pocketing.A_3,
    Stream5=line,
    Stream6=re_machining.T_2)  # -> simplify(Stream)

flatten_2 = FlattenTree(Tree=filter_24, Path="{0}")
clickm = ClickableMesh(Enable=start_selection, Meshes=flatten_2)  # -> SelectedMeshes, SelectedIndices, MouseLine
cluster_5 = Cluster_2(
    enable=start_selection,
    reset=reset_selection,
    d1=clickm.SelectedIndices,
    G=clickm.SelectedMeshes,
    L=flatten_2,
    i=clickm.SelectedIndices,
    L_2=flatten_2,
    P=area.Centroid,
    L_3=flatten_2,
    A=filter_10)  # -> T, T_2, L_4, R, s_0
filter_25 = StreamFilter(Gate=start_selection, Stream1=cluster_5.T)
filter_26 = StreamFilter(Gate=cluster_5.R, Stream1=cluster_5.T_2)

sort_groups = SortGroups(T=filter_24)  # -> D, D_2
lng_3 = ListLength(List=flatten(filter_24))
smaller = SmallerThan(FirstNumber=lng_3, SecondNumber=1)  # -> SmallerThan, OrEqualTo
filter_27 = StreamFilter(Gate=smaller.OrEqualTo, Stream0=filter_10, Stream1=0)
pdecon_2 = Deconstruct(Point=sort_groups.D_2)  # -> XComponent, YComponent, ZComponent
pdecon_3 = Deconstruct(Point=sort_groups.D_2)  # -> XComponent, YComponent, ZComponent
center_between_pts = CenterBetweenPts(L=sort_groups.D_2)
cp = ClosestPoint(Point=wcs, Cloud=sort_groups.D_2)  # -> ClosestPoint, CPIndex, Distance
autosorting = GhPythonScript(start_point=wcs, other_points=sort_groups.D_2)  # -> out, sorted_points; inputs other_points: list of Point3d
# ---------- autosorting: Python ----------
__author__ = "Siemen"

import rhinoscriptsyntax as rs


def shortestpath(spt, pts):
    
    Origin = (0,0,0)
    start_point = spt
    orderedlist = []
    cullist = pts
    
    
    
    distlist =[]
    
    for x in pts:
        distlist = []
        for x in cullist:
            
            dist = rs.Distance(start_point, x)
            dist = float(dist)
            
            distlist.append(dist)
            
        
        comblist = zip(distlist,cullist)
        
        comblist.sort()
        
        comblist = zip(*comblist)
        
        
        cullist = list(comblist[1])
        
        
        
        start_point = cullist[0]
        
        orderedlist.append(start_point)
        cullist.remove(start_point)
        
        
    return orderedlist
    
    
    
    
if other_points:
    if not start_point: start_point = (0,0,0)
    sorted_points = shortestpath(start_point, other_points)
else:
    print "No input curves"
# ---------- end autosorting ----------
sort = SortList(Keys=pdecon_2.YComponent, ValuesA=pdecon_2.XComponent)  # -> Keys, ValuesA
sort_2 = SortList(Keys=pdecon_3.XComponent, ValuesA=pdecon_3.YComponent)  # -> Keys, ValuesA
python_3 = PythonScript(Points=sort_groups.D_2, Center=center_between_pts)  # -> SortedPoints, Plane; inputs Points: list
# ---------- python_3: Python ----------
import Rhino as rc

def sortPointsAroundCenter(pts,center):
    
    """ Sort a list of points radially around a center """
    
    # Make plane through points and set its origin
    test,plane = rc.Geometry.Plane.FitPlaneToPoints(pts)
    plane.Origin = center
    
    # Calculate vectors from center to points
    vecs = [pt - center for pt in pts]
    
    # Calculate angles between vectors and plane X-axis
    angles = [rc.Geometry.Vector3d.VectorAngle(plane.XAxis,v,plane) for v in vecs]
    
    # Sort points by angles
    sortedBoth = sorted(zip(angles,pts))
    sortedPts = [l[1] for l in sortedBoth]
    
    return sortedPts,plane
    

if Points and Center:
    
    SortedPoints,Plane = sortPointsAroundCenter(Points,Center)
# ---------- end python_3 ----------
seqsort = SequentiallySort(Points=sort_groups.D_2, Start=cp.CPIndex)  # -> out, Sorted; inputs Points: list of Point3d, Start: Int32
# ---------- seqsort: Python ----------
"""Sequentially sort points by distance.
    Inputs:
        Points: The list of sample points to sort
        Start: The start point for sorting
    Output:
        Sorted: The sorted list of points"""

__author__ = "diff-arch"
__version__ = "0.1.1 (2020-09-25)"


ghenv.Component.Name = "Sequentially Sort"
ghenv.Component.NickName = "SeqSort"


import Rhino.Geometry as rg


def sort_sequentially_rec(pt_cloud, start=0, _sorted_pts=[]):
    """Recursively sorts points by distance.

    Args:
      pt_cloud (Rhino.Geometry.PointCloud): A point cloud to sort
      start (int): A start point index to sort from

    Returns:
      The sequentially sorted points.
    """
    if pt_cloud.Count < 1:
        return _sorted_pts

    test_pt = pt_cloud.PointAt(start)
    _sorted_pts.append(test_pt)
    pt_cloud.RemoveAt(start)

    closest = pt_cloud.ClosestPoint(test_pt)
    if closest == -1:
        return _sorted_pts

    return sort_sequentially_rec(pt_cloud, closest, _sorted_pts)


if __name__ == "__main__":
    # Create a point cloud from the list of points
    pt_cloud = rg.PointCloud(Points)
    # Outputs
    Sorted = sort_sequentially_rec(pt_cloud, Start)
# ---------- end seqsort ----------
pt = ConstructPoint(XCoordinate=sort.ValuesA, YCoordinate=sort.Keys, ZCoordinate=0)
pt_2 = ConstructPoint(XCoordinate=sort_2.Keys, YCoordinate=sort_2.ValuesA, ZCoordinate=0)
pt_3 = Point(reverse(pt_2))
pt_4 = Point(reverse(pt))
filter_28 = StreamFilter(
    Gate=filter_27,
    Stream0=sort_groups.D_2,
    Stream1=pt,
    Stream2=pt_4,
    Stream3=pt_2,
    Stream4=pt_3,
    Stream5=flatten(seqsort.Sorted),
    Stream6=cluster_5.s_0)
lng_4 = ListLength(List=filter_28)
cp_2 = ClosestPoint(Point=filter_28, Cloud=flatten(sort_groups.D_2))  # -> ClosestPoint, CPIndex, Distance
series = Series(Start=0, Step=1, Count=lng_4)
int = Integer(cp_2.CPIndex)
int_2 = Integer(series)
cset_4 = CreateSet(List=cp_2.CPIndex)  # -> Set, Map
difference = SetDifference(SetA=int_2, SetB=int)
lng_5 = ListLength(List=difference)
larger_3 = LargerThan(FirstNumber=lng_5, SecondNumber=0)  # -> LargerThan, OrEqualTo
ins_3 = InsertItems(List=cset_4.Set, Item=difference, Indices=-1, Wrap=True)
filter_29 = StreamFilter(Gate=larger_3.LargerThan, Stream0=cp_2.CPIndex, Stream1=ins_3)
Z_3 = UnitZ(Factor=unweave.Data0)
Z_4 = UnitZ(Factor=clearance_plane)
path_4 = ConstructPath(Indices=graft(filter_29))  # -> flatten(Branch)
branch_4 = TreeBranch(Tree=simplify(sort_groups.D), Path=path_4, MaintainPaths=False)
graft_3 = GraftTree(Tree=branch_4, IncludeEmptyLists=True, IncludeNullItems=True)
renumber_7 = RenumberPaths(Data=graft_3)
move_4 = Move(Geometry=renumber_7, Motion=Z_3)  # -> Geometry, Transform
Z_5 = UnitZ(Factor=expr("-x", filter_15))
move_5 = Move(Geometry=move_4.Geometry, Motion=Z_5)  # -> Geometry, Transform
lng_6 = ListLength(List=Z_5)
divide = DivideCurve(Curve=move_4.Geometry, Count=lng_6, Kinks=False)  # -> Points, Tangents, Parameters
shatter = Shatter(Curve=move_4.Geometry, Parameters=divide.Parameters)
equality = Equality(FirstNumber=filter_12, SecondNumber=2)  # -> Equality, Inequality

# ---- group: V-Carve
equals_2 = Equality(FirstNumber=filter_9, SecondNumber=4)  # -> Equality, Inequality
filter_30 = StreamFilter(Gate=equals_2.Equality, Stream1=merge_11)
prune_4 = PruneTree(Tree=filter_30, Minimum=1, Maximum=0)
move_6 = Move(Geometry=prune_4, Motion=Z_3)  # -> Geometry, Transform
cluster_6 = Cluster(G=move_6.Geometry, x=filter_7, A=python_2.bit_angle, A_2=subtraction_3, L=round.Ceiling)  # -> R, L_2
preview_14 = CustomPreview(Geometry=cluster_6.L_2, Material=ColourSwatch(SwatchColor=RGBA(26, 112, 86, 60)))

# ----
filter_31 = StreamFilter(
    Gate=filter_9,
    Stream0=move_5.Geometry,
    Stream1=move_5.Geometry,
    Stream2=move_5.Geometry,
    Stream3=move_5.Geometry,
    Stream4=cluster_6.R,
    Stream5=shatter,
    Stream6=move_5.Geometry)
cls = Closed(Curve=filter_31)  # -> Closed, Periodic
unweave_2 = Unweave(List=filter_31, UnweavePattern=cls.Closed)  # -> Data0, Data1
unweave_3 = Unweave(List=unweave_2.Data1, UnweavePattern=[0, 1])  # -> Data0, Data1
unweave_4 = Unweave(List=unweave_2.Data0, UnweavePattern=[0, 1])  # -> Data0, Data1
flip_11 = FlipCurve(Curve=unweave_3.Data1)  # -> Curve, Flag
flip_12 = FlipCurve(Curve=unweave_4.Data1)  # -> Curve, Flag
weave = Weave(Pattern=[0, 1], Stream0=unweave_3.Data0, Stream1=flip_11.Curve, NullGaps=False)
weave_2 = Weave(Pattern=[0, 1], Stream0=unweave_4.Data0, Stream1=flip_12.Curve, NullGaps=False)
filter_32 = StreamFilter(Gate=equality.Equality, Stream0=unweave_2.Data1, Stream1=weave)
filter_33 = StreamFilter(Gate=equality.Equality, Stream0=unweave_2.Data0, Stream1=weave_2)
weave_3 = Weave(Pattern=cls.Closed, Stream0=filter_33, Stream1=filter_32, NullGaps=False)
cluster_7 = Cluster_6(C=weave_3)
gate_4 = StreamGate(Stream=cluster_7, Gate=cut_levels_order)  # -> Target0, Target1
flip_last = FlipLast(Data=gate_4.Target1)
filter_34 = StreamFilter(Gate=cut_levels_order, Stream0=gate_4.Target0, Stream1=flip_last)
end = EndPoints(Curve=filter_34)  # -> Start, End
tstat_3 = TreeStatistics(Tree=filter_34)  # -> Paths, Length, Count
pdecon_4 = Deconstruct(Point=end.End)  # -> XComponent, YComponent, ZComponent
cset_5 = CreateSet(List=tstat_3.Length)  # -> Set, Map
pt_5 = ConstructPoint(XCoordinate=pdecon_4.XComponent, YCoordinate=pdecon_4.YComponent, ZCoordinate=addition_2)

cls_2 = Closed(Curve=filter_34)  # -> Closed, Periodic
unweave_5 = Unweave(List=filter_34, UnweavePattern=cls_2.Closed)  # -> Data0, Data1
flip_13 = FlipCurve(Curve=unweave_5.Data1)  # -> simplify(Curve), Flag
lng_7 = ListLength(List=filter_16)
weave_4 = Weave(Pattern=cls_2.Closed, Stream0=unweave_5.Data0, Stream1=flip_13.Curve, NullGaps=False)
repeat = RepeatData(Data=0, Length=lng_7)
equals_3 = Equality(FirstNumber=filter_9, SecondNumber=5)  # -> Equality, Inequality
merge_12 = Merge(Data1=0, Data2=path_length)
graft_4 = GraftTree(Tree=weave_4, IncludeEmptyLists=True, IncludeNullItems=True)
filter_35 = StreamFilter(Gate=equals_3.Equality, Stream0=filter_16, Stream1=repeat)
eval = EvaluateLength(Curve=graft_4, Length=merge_12, Normalized=invert(True))  # -> Point, Tangent, Parameter
end_2 = EndPoints(Curve=weave_4)  # -> Start, End
Z_6 = UnitZ(Factor=filter_35)
shatter_2 = Shatter(Curve=graft_4, Parameters=eval.Parameter)
move_7 = Move(Geometry=end_2.Start, Motion=Z_6)  # -> Geometry, Transform
item_7 = ListItem(List=shatter_2, Index=0, Wrap=True)
ln = Line(StartPoint=move_7.Geometry, EndPoint=end_2.Start)
partition = PartitionList(List=flatten(item_7), Size=cset_5.Set)
equals_4 = Equality(FirstNumber=path_length, SecondNumber=0)  # -> Equality, Inequality
smaller_2 = SmallerThan(FirstNumber=entry, SecondNumber=1)  # -> SmallerThan, OrEqualTo
cluster_8 = Cluster_3(G=partition, B=division_2)  # -> simplify(C)
or = GateOr(A=equals_4.Equality, B=smaller_2.SmallerThan)
cluster_9 = Cluster_4(T=cluster_8)
filter_36 = StreamFilter(Gate=or, Stream0=cluster_9, Stream1=ln)

preview_15 = CustomPreview(Geometry=filter_36, Material=ColourSwatch(SwatchColor=RGB(217, 13, 108)))
preview_16 = CustomPreview(Geometry=filter_34, Material=ColourSwatch(SwatchColor=RGB(34, 227, 227)))
toggle_5 = GroupToggle(ToggleActive=True, ToggleVisible=False)  # disabled

item_8 = ListItem(List=filter_31, Index=0, Wrap=True)
geo_to_g_code = GeoToGCode(
    x0=pdecon.XComponent,
    y0=pdecon.YComponent,
    Z=addition_2,
    cut_feedrate=cut_feed_mm_min,
    engage_feedrate=engage_feed_mm_min,
    C=filter_36,
    C_2=filter_34,
    A=end.End,
    B=pt_5,
    D=item_6.Item1,
    layercolor=geoattributes_2.GC)  # -> geometry, R, R_2, L_2, L, L_3, D_2
lng_8 = ListLength(List=geo_to_g_code.R)
entwine_5 = Entwine(Branch00=geo_to_g_code.R, Branch01=geo_to_g_code.R_2, FlattenInputs=True)  # -> simplify(Result)
larger_4 = LargerThan(FirstNumber=lng_8, SecondNumber=1)  # -> LargerThan, OrEqualTo
filter_37 = StreamFilter(Gate=larger_4.LargerThan, Stream1=entwine_5)
remote_sender = RemoteSender(filter_37)
connected = GetConnectedObjects(Objects=remote_sender)
rename = RenameObject(Objects=connected, Names=concat_3)

end_3 = EndPoints(Curve=item_8)  # -> flatten(Start), flatten(End)
lng_9 = ListLength(List=end_3.Start)
series_2 = Series(Start=1, Step=1, Count=lng_9)
textdot = DefineTextDot(Text=series_2, Location=end_3.Start, Font="Arial", Size=Slider(9, range=0..100))
toggle_6 = GroupToggle(ToggleActive=True, ToggleVisible=False)  # disabled

# ---- group: Simulate
num = Number(Slider(0, range=0..1))
crv_3 = Curve(geo_to_g_code.geometry)
item_9 = ListItem(List=geo_to_g_code.R_2, Index=-1, Wrap=True)
road_visualization = RoadVisualization(crv=flatten(crv_3), rate=num, d=filter_5, h=python_2.bit_h)  # -> out, a, b; inputs crv: list of Curve
# ---------- road_visualization: Python ----------
import rhinoscriptsyntax as rs

if accuracy is None: accuracy = 0.3
if h is None: h = 20
if accuracy == 0: accuracy = 0.1
pts = []
for i in range(len(crv)):
    crv_pts = rs.DivideCurveLength(crv[i], accuracy)
    end_pt = rs.CurveEndPoint(crv[i])
    pts.extend(crv_pts)
    if crv_pts[-1] != end_pt:
        pts.append(end_pt)



tmp = []
length = int(len(pts)*rate)
if length > 1:
    for k in range(length):
        tmp.append(pts[k])
    a = rs.AddPolyline(tmp)
    nozzle_plane = rs.CreatePlane(tmp[-1],
                                  rs.CreateVector(1,0,0),
                                  rs.CreateVector(0,1,0))
    b = rs.AddCylinder(nozzle_plane, int(h), int(d)/2, cap=True)
# ---------- end road_visualization ----------
material_11 = CreateMaterial(Diffuse=item_9, Specular=RGB(255, 255, 255), Emission=RGB(0, 0, 0), Transparency=0, Shine=0)
crv_4 = Curve(road_visualization.a)
brep = Brep(road_visualization.b)
preview_17 = CustomPreview(Geometry=[road_visualization.a, road_visualization.b], Material=material_11)

# ----
swatch_7 = ColourSwatch(SwatchColor=RGB(227, 34, 34))
swatch_8 = ColourSwatch(SwatchColor=RGB(13, 47, 217))
crvdir_6 = CurveDirectionDisplay(Curves=geo_to_g_code.L, Color=swatch_8, Size=Slider(12, range=0..20))
preview_18 = CustomPreview(Geometry=geo_to_g_code.L_2, Material=ColourSwatch(SwatchColor=RGB(122, 24, 163)))
preview_19 = CustomPreview(Geometry=geo_to_g_code.D_2, Material=swatch_7)
preview_20 = CustomPreview(Geometry=geo_to_g_code.L_3, Material=ColourSwatch(SwatchColor=RGB(163, 24, 24)))
preview_21 = CustomPreview(Geometry=geo_to_g_code.L, Material=swatch_8)
toggle_7 = GroupToggle(ToggleActive=False, ToggleVisible=True)  # disabled

remote_receiver = RemoteReceiver(remote_sender)
connected_2 = GetConnectedObjects(Objects=remote_receiver)
concat_6 = Concatenate(FragmentA=knob, FragmentC="-", FragmentB="1")
rename_2 = RenameObject(Objects=connected_2, Names=concat_6)

crvdir_7 = CurveDirectionDisplay(Curves=geo_to_g_code.D_2, Color=swatch_7, Size=Slider(12, range=0..20))
_1 = Text(remote_receiver)
bang = ExplodeTree(Data=_1)  # -> Branch0, Branch1
merge_13 = Merge(Data1=start_code, Data2=bang.Branch0, Data3=end_code)
lng_10 = ListLength(List=merge_13)
larger_5 = LargerThan(FirstNumber=lng_10, SecondNumber=6)  # -> LargerThan, OrEqualTo
filter_38 = StreamFilter(Gate=larger_5.LargerThan, Stream1=merge_13)
stream_code = FileCreator(name=panel_10, ext="tap", lines=filter_38, write=save, open_folder=open_folder, path=toolpath_streaming_folder)  # inputs lines: list, write: Boolean
#   port name: Desired file name.
# ---------- stream_code: Python ----------
#Tweaked by Siemen Cuypers / 2019

ghenv.Component.Name = "File Creator"

import rhinoscriptsyntax as rs
import Grasshopper as gh
import os
import time

# Set varible to desired folder path
def Export(ext):
    
    dir = path
    txt = name + "." + ext
    
    if dir:
        file=str(dir)+ '\\' + txt
    filePath = open(file, "w") # Open the file
    for line in lines: # Iterate through lines
        filePath.write(line + "\n") # Write separate lines
    filePath.close() # Close the file

if write:
    if path:
        Export(ext)
    else:
        msg = "Set directory path for streaming"
        ghenv.Component.AddRuntimeMessage(gh.Kernel.GH_RuntimeMessageLevel.Warning, msg)
else:
    msg = "Set 'write' to True for streaming"
    ghenv.Component.AddRuntimeMessage(gh.Kernel.GH_RuntimeMessageLevel.Warning, msg)
    
if open_folder:
    os.startfile(path)
# ---------- end stream_code ----------

_1_2 = Text(bang.Branch1)
unweave_6 = Unweave(List=_1_2, UnweavePattern=[0, 1, 2])  # -> Data0, Data1, Data2
weave_5 = Weave(Pattern=[0, 1], Stream0=unweave_6.Data1, Stream1=unweave_6.Data2, NullGaps=False)
ma_6 = MassAddition(Input=unweave_6.Data0)  # -> Result, PartialResults
join = TextJoin(Text=weave_5)

entwine_6 = Entwine(Branch00=format_12, Branch01=ma_6.Result, Branch02=join, FlattenInputs=True)
d1 = RemoteSender(entwine_6)
connected_3 = GetConnectedObjects(Objects=d1)
rename_3 = RenameObject(Objects=connected_3, Names=concat_4)

d1_2 = RemoteReceiver(d1)

# ---- group: Operation Description
merge_14 = Merge(
    Data1=flatten(d1_2),
    Data2=flatten(d2),
    Data3=flatten(d3),
    Data4=flatten(d4),
    Data5=flatten(d5),
    Data6=flatten(d6),
    Data7=flatten(d7),
    Data8=flatten(d8),
    Data9=flatten(d9),
    Data10=flatten(d10),
    Data11=flatten(d11),
    Data12=flatten(d12),
    Data13=flatten(d13))
unweave_7 = Unweave(List=merge_14, UnweavePattern=[0, 1, 2])  # -> Data0, Data1, Data2
split_5 = TextSplit(Text=unweave_7.Data0, Separators=".")
split_6 = SplitList(List=split_5, Index=1)  # -> flatten(ListA), flatten(ListB)
sort_3 = SortList(Keys=split_6.ListA, ValuesA=unweave_7.Data0, ValuesB=unweave_7.Data1)  # -> Keys, ValuesA, ValuesB
sort_4 = SortList(Keys=split_6.ListA, ValuesA=unweave_7.Data0, ValuesB=unweave_7.Data2)  # -> Keys, ValuesA, ValuesB
ma_7 = MassAddition(Input=unweave_7.Data1)  # -> Result, PartialResults
python_4 = GhPythonScript(x=ma_7.Result)  # -> a
# ---------- python_4: Python ----------
__author__ = "Saha"
__version__ = "2023.03.07"

import rhinoscriptsyntax as rs
import time

if x:
    a = time.strftime("%H:%M:%S", time.gmtime(x*60))
# ---------- end python_4 ----------
ins_4 = InsertItems(List=sort_3.ValuesA, Item="Total", Indices=-1, Wrap=True)
make_lenght_of_text_equal = MakeLenghtOfTextEqual(T=ins_4)

# ----
python_5 = GhPythonScript(x=sort_3.ValuesB)  # -> a; same code as python_4

number_slider_4 = Slider(50, range=0..1000)
division_5 = Division(A=number_slider_4, B=2)
offset_7 = OffsetCurve(Curve=filter_3, Distance=division_5, Corners=1)
offset_8 = OffsetCurve(Curve=bbox.Rect, Distance=number_slider_4, Corners=1)
graft_5 = GraftTree(Tree=filter_3, IncludeEmptyLists=True, IncludeNullItems=True)
number_slider_5 = Slider(76, range=0..100)

# ---- group: BBox
bbox_2 = GhPythonScript(object=offset_7)  # -> out, box, X, Y, Max, Min, Rect; inputs object: list; same code as bbox

# ----
bbox_3 = GhPythonScript(object=graft_5)  # -> out, box, X, Y, Max, Min, Rect; inputs object: list; same code as bbox
bbox_4 = GhPythonScript(object=offset_8)  # -> out, box, X, Y, Max, Min, Rect; same code as bbox

num_2 = Number(bbox_3.X)
num_3 = Number(bbox_3.Y)
explode = Explode(Curve=bbox_2.Rect, Recursive=True)  # -> Segments, Vertices
explode_2 = Explode(Curve=bbox_4.Rect, Recursive=True)  # -> Segments, Vertices
shift = ShiftList(List=explode.Segments, Shift=1, Wrap=True)
item_10 = ListItem(List=explode_2.Segments, Index=0, Wrap=True)  # -> Item, Item1, Item2, Item3
explode_3 = Explode(Curve=bbox_4.Rect, Recursive=True)  # -> Segments, Vertices
midpt = CurveMiddle(Curve=item_10.Item1)
midpt_2 = CurveMiddle(Curve=shift)  # -> reverse(Midpoint)
midpt_3 = CurveMiddle(Curve=explode_3.Segments)  # -> reverse(Midpoint)
item_11 = ListItem(List=midpt_3, Index=0, Wrap=True)

round_to_decimal_place = GhPythonScript(X=num_2, Y=num_3, d=1)  # -> rX, rY, rZ, rI, rJ; inputs X: list, Y: list, Z: list, I: list, J: list, d: Int32; same code as round_to_decimal_place

# ---- group: Operation Description (continued)
ins_5 = InsertItems(List=python_5, Item=python_4, Indices=-1, Wrap=True)
format_13 = Format(Format="{0} | {1}", Culture=127, Data0=make_lenght_of_text_equal, Data1=ins_5)
weave_6 = Weave(Pattern=[0, 1], Stream0=format_13, Stream1=sort_4.ValuesB, NullGaps=False)  # -> graft(Weave)
join_2 = TextJoin(Text=format_13)
renumber_8 = RenumberPaths(Data=weave_6)
divide_branches = DivideBranches(DataTree=renumber_8, DivisionPattern=[0, 1], RenumberPaths=False)  # -> Data0, Data1

# ----
split_7 = TextSplit(Text=divide_branches.Data1)
len_3 = TextLength(Text=split_7)
cull_2 = CullPattern(List=split_7, CullPattern=len_3)
dispatch_3 = Dispatch(List=simplify(cull_2), DispatchPattern=[True, False])  # -> ListA, ListB
replace_2 = ReplaceItems(List=divide_branches.Data0, Item=ColourSwatch(SwatchColor=RGB(0, 72, 255)), Indices=0, Wrap=False)  # -> simplify(List)
replace_3 = ReplaceItems(List=divide_branches.Data0, Item=Slider(50, range=0..100), Indices=0, Wrap=False)  # -> simplify(List)
replace_4 = ReplaceItems(List=divide_branches.Data0, Item=Slider(0, range=0..100), Indices=0, Wrap=False)  # -> simplify(List)
addition_5 = Addition(A=replace_3, B=Slider(10, range=0..100))
pdecon_5 = Deconstruct(Point=midpt)  # -> XComponent, YComponent, ZComponent

cluster_10 = Cluster_4(T=dispatch_3.ListB)
lng_11 = ListLength(List=cluster_10)
series_3 = Series(Start=0, Step=1, Count=lng_11)  # -> expr("x+1", Series)
concat_7 = Concatenate(FragmentC=series_3, FragmentA=".", FragmentB=dispatch_3.ListA)
cluster_11 = Cluster_4(T=concat_7)
panel_11 = Panel(pdecon_5.XComponent)

lng_12 = ListLength(List=cluster_10)
lng_13 = ListLength(List=cluster_10)
series_4 = Series(Start=0, Step=1, Count=lng_12)
series_5 = Series(Start=0, Step=1, Count=lng_13)
replace_5 = ReplaceItems(List=cluster_10, Item=Slider(40, range=0..100), Indices=series_4, Wrap=False)  # -> simplify(List)
replace_6 = ReplaceItems(List=cluster_10, Item=Slider(35, range=0..100), Indices=series_5, Wrap=False)  # -> simplify(List)
merge_15 = Merge(Data1=replace_4, Data2=replace_6)
merge_16 = Merge(Data1=divide_branches.Data0, Data2=cluster_11)
merge_17 = Merge(Data1=replace_2, Data2=cluster_10)
merge_18 = Merge(Data1=replace_2, Data2=cluster_10)
col = Colour(merge_17)
addition_6 = Addition(A=pdecon_5.XComponent, B=merge_15)
legend = Legend(Colour=flatten(merge_18), Tags=flatten(merge_16), LegendType=1)

cluster_12 = Cluster_4(T=replace_5)
panel_12 = Panel(merge_16)

addition_7 = Addition(A=cluster_12, B=Slider(10, range=0..100))
merge_19 = Merge(Data1=addition_5, Data2=addition_7)
merge_20 = Merge(Data1=replace_3, Data2=cluster_12)
flatten_3 = FlattenTree(Tree=merge_19, Path="{0}")
ma_8 = MassAddition(Input=flatten(flatten_3))  # -> Result, PartialResults
unflatten = UnflattenTree(Tree=ma_8.PartialResults, Guide=merge_19)
neg_3 = Negative(Value=unflatten)
addition_8 = Addition(A=pdecon_5.YComponent, B=neg_3)
pt_6 = ConstructPoint(XCoordinate=addition_6, YCoordinate=addition_8, ZCoordinate=0)

number_slider_6 = Slider(8, range=0..10)
pdecon_6 = Deconstruct(Point=pt_6)  # -> XComponent, YComponent, ZComponent
cir_5 = Circle(Plane=wcs, Radius=Slider(10, range=0..10))
divide_2 = DivideCurve(Curve=cir_5, Count=4, Kinks=False)  # -> Points, Tangents, Parameters
divide_3 = DivideCurve(Curve=cir_5, Count=number_slider_6, Kinks=False)  # -> Points, Tangents, Parameters
dispatch_4 = Dispatch(List=divide_2.Points, DispatchPattern=[True, False])  # -> ListA, ListB
cull_i = CullIndex(List=midpt_2, Indices=-1, Wrap=True)
split_8 = TextSplit(Text=list, Separators="x")
dpipeline = DynamicGeometryPipeline(
    LayerFilter="Default",
    TypeFilter="Text",
    NameFilter="*",
    GroupByLayer=False,
    GroupByType=False,
    IncludeHidden=True,
    IncludeLocked=True,
    enableFullPath=False,
    listenToAttributes=True)
item_12 = ListItem(List=divide_3.Points, Index=expr("x+1", number_slider_6), Wrap=True)
pline = PolyLine(Vertices=dispatch_4.ListA, Closed=False)
pline_2 = PolyLine(Vertices=dispatch_4.ListB, Closed=False)
item_13 = ListItem(List=split_8, Index=0, Wrap=True)
lng_14 = ListLength(List=bbox_2.Rect)
swatch_9 = ColourSwatch(SwatchColor=RGB(0, 255, 4))
swatch_10 = ColourSwatch(SwatchColor=RGB(255, 0, 0))
swatch_11 = ColourSwatch(SwatchColor=RGB(0, 38, 255))
id = Guid(dpipeline)
dup = DuplicateData(Data=item_13, Number=lng_14, Order=True)
font = CreateGdiFont(Typeface="Cascadia Mono SemiBold", Size=merge_20, Bold=False, Italic=False)
preview_22 = CustomPreview(Geometry=pline, Material=swatch_9)
preview_23 = CustomPreview(Geometry=pline_2, Material=swatch_10)
preview_24 = CustomPreview(Geometry=cir_5, Material=swatch_11)
python_6 = PythonScript(id=id)  # -> out, text, plane, font, style, pt, fHeight, oPnts
# ---------- python_6: Python ----------
import rhinoscriptsyntax as rs
import Rhino as rc
import scriptcontext as sc
import Rhino.Geometry as rg

# Set the script context to the current Rhino doc
sc.doc = rc.RhinoDoc.ActiveDoc

# Do your Rhino doc business...
if id:
    tObj = rs.coercerhinoobject(id)
    text = tObj.DisplayText
    plane = tObj.Geometry.Plane
    font = rs.TextObjectFont(id)
    fHeight = rs.TextObjectHeight(id)
    style = rs.TextObjectStyle(id)
    pt = rs.TextObjectPoint(id)
    tPl = rs.TextObjectPlane(id)
    tTxtCrvs = rg.TextEntity.Explode(rs.coercegeometry(id))

    tTxtCrvsL = []
    for i in tTxtCrvs:
        tTxtCrvsL.append(i)

    tPnt  = rs.BoundingBox(tTxtCrvsL,tPl)
    oPnts = tPnt[0:4]
    
# Then set the script context back to the Grasshopper doc
sc.doc = ghdoc
# ---------- end python_6 ----------
renumber_9 = RenumberPaths(Data=round_to_decimal_place.rX)
renumber_10 = RenumberPaths(Data=round_to_decimal_place.rY)
renumber_11 = RenumberPaths(Data=dup)
number_slider_7 = Slider(6, range=0..10)
incurves = PointInCurves(Point=python_6.pt, Curves=filter_3)  # -> Relationship, Index, Point
merge_21 = Merge(Data1=simplify(renumber_9), Data2=simplify(renumber_10), Data3=simplify(renumber_11))
X = UnitX(Factor=1)
col_2 = Colour(geoattributes.GC)
txt_6 = Text(geoattributes.GC)
align = AlignPlane(Plane=python_6.plane, Direction=X)  # -> Plane, Angle
sift = SiftPattern(List=python_6.text, SiftPattern=incurves.Relationship)  # -> Output0, Output1, Output2
sift_2 = SiftPattern(List=python_6.pt, SiftPattern=incurves.Relationship)  # -> Output0, Output1, Output2
subtraction_4 = Subtraction(A=item_2.Item1, B=remap.Clipped)
sort_5 = SortList(Keys=txt_6, ValuesA=filter_4, ValuesB=col_2)  # -> Keys, ValuesA, ValuesB
font_2 = CreateGdiFont(Typeface="Cascadia Mono SemiBold", Size=Slider(30, range=0..50), Bold=invert(False), Italic=False)
font_3 = CreateGdiFont(Typeface=python_6.font, Size=python_6.fHeight, Bold=invert(False), Italic=False)
edge = CreateGdiEdge(Width=Slider(8, range=0..10), Colour=swatch, EndCap=2, DashCap=0)
edge_2 = CreateGdiEdge(Width=Slider(6, range=0..10), Colour=sort_5.ValuesB, EndCap=2, DashCap=0)
font_4 = CreateGdiFont(Typeface="Cascadia Mono SemiBold", Size=Slider(15, range=0..20), Bold=invert(False), Italic=False)
concat_8 = Concatenate(FragmentA="Z=", FragmentB=subtraction_4)
edge_3 = CreateGdiEdge(Width=number_slider_7, Colour=swatch_11, EndCap=0, DashCap=0)
edge_4 = CreateGdiEdge(Width=number_slider_7, Colour=swatch_10, EndCap=0, DashCap=0)
edge_5 = CreateGdiEdge(Width=number_slider_7, Colour=swatch_9, EndCap=0, DashCap=0)
panel_13 = Panel("""0
270
0""")
shape = CreateGdiShape(Geometry=filter_3, Edge=edge)
shape_2 = CreateGdiShape(Geometry=sort_5.ValuesA, Edge=edge_2)
shape_3 = CreateGdiShape(Geometry=pline, Edge=edge_4)
shape_4 = CreateGdiShape(Geometry=pline_2, Edge=edge_5)
shape_5 = CreateGdiShape(Geometry=cir_5, Edge=edge_3)
aligntext = CreateAlignedText(
    Text=concat_8,
    Font=font_4,
    Location=item_12,
    Colour=swatch_11,
    Horizontal=Slider(1.2, range=0..10),
    Vertical=0,
    Angle=degrees(0))
aligntext_2 = CreateAlignedText(Text=merge_21, Font=font_2, Location=cull_i, Colour=swatch, Horizontal=[0, 0, 0], Vertical=0, Angle=degrees(panel_13))
aligntext_3 = CreateAlignedText(
    Text=sift.Output2,
    Font=font_3,
    Location=sift_2.Output2,
    Colour=ColourSwatch(SwatchColor=RGB(0, 0, 0)),
    Horizontal=0,
    Vertical=0,
    Angle=align.Angle)
toolpath_streaming_folder_2 = FilePath("E:\Работа\Simple CNC Post TEST\")
null_9 = NullItem(Item=aligntext_3)  # -> NullFlags, InvalidFlags, Description
panel_14 = Panel("Cascadia Mono SemiBold")
concat_9 = Concatenate(FragmentA=toolpath_streaming_folder_2, FragmentB="Image", FragmentC=".png")
cull_3 = CullPattern(List=aligntext_3, CullPattern=invert(null_9.NullFlags))
toggle_8 = GroupToggle(ToggleActive=True, ToggleVisible=False)  # disabled

text = DefineTextObject(
    Text=merge_16,
    Plane=pt_6,
    DimensionStyle="Default",
    Justification="BottomLeft",
    Size=merge_20,
    Font="Cascadia Mono SemiBold",
    OutputType="Text")
preview_25 = CustomPreview(Geometry=text, Material=col)

# ---- group: Operation Description (continued)
brec = BoundingRectangle(Geometry=flatten(text), Plane=PlaneXY(0, 0, 0), Axis=0, Slide=0, Union=True)  # -> Bounding, DimensionX, DimensionY
subtraction_5 = Subtraction(A=brec.DimensionX, B=Slider(150, range=0..1000))

# ----
addition_9 = Addition(A=bbox_4.X, B=brec.DimensionX)
addition_10 = Addition(A=brec.DimensionY, B=Slider(50, range=0..1000))
division_6 = Division(A=addition_9, B=bbox_4.X)
division_7 = Division(A=addition_10, B=bbox_4.Y)
eval_2 = Evaluate(F="if(x>1,x,1)", x=division_7)
scale_nu = ScaleNU(Geometry=bbox_4.Rect, Plane=item_11, ScaleX=division_6, ScaleY=eval_2, ScaleZ=1)  # -> Geometry, Transform

division_8 = Division(A=addition_10, B=2)
addition_11 = Addition(A=pdecon_6.YComponent, B=division_8)
pt_7 = ConstructPoint(XCoordinate=pdecon_6.XComponent, YCoordinate=addition_11, ZCoordinate=0)
aligntext_4 = CreateAlignedText(Text=merge_16, Font=font, Location=pt_7, Colour=col, Horizontal=Slider(1, range=0..10), Vertical=0, Angle=degrees(0))
merge_22 = Merge(
    Data1=shape,
    Data2=shape_2,
    Data3=shape_3,
    Data4=shape_4,
    Data5=shape_5,
    Data6=aligntext,
    Data8=cull_3,
    Data9=aligntext_2,
    Data10=flatten(aligntext_4))  # -> flatten(Result)
draw = DrawImage(
    Shapes=merge_22,
    Size=scale_nu.Geometry,
    Factor=Slider(2, range=0..10),
    Background=ColourSwatch(SwatchColor=RGB(150, 150, 150)),
    AntiAlias=True,
    FileLocation=concat_9)

# ==== cluster MakeLenghtOfTextEqual
T = ClusterInput()
len = TextLength(Text=T)
dispatch = Dispatch(List=len, DispatchPattern=[True, False])  # -> ListA, ListB
max = Maximum(A=dispatch.ListA, B=dispatch.ListB)
subtraction = Subtraction(A=max, B=len)
dup = DuplicateData(Data=" ", Number=subtraction, Order=True)
join = TextJoin(Text=dup)
concat = Concatenate(FragmentA=graft(T), FragmentB=join)  # -> flatten(Result)
R = ClusterOutput(concat)

# ==== cluster STARTCODE

# ---- group: Delay (sec.)
sec = Slider(5, range=0..30)
multiplication = Multiplication(A=sec, B=1000)
format = Format(Format="G04 P{0}", Culture=127, Data0=multiplication)

# ---- group: Spindle Speed
format_2 = Format(Format="M3 S{0}", Culture=127, Data0=Slider(18000, range=1000..18000))

# ----
merge = Merge(Data1="G17 G40 G90 G21", Data2=format_2, Data3=format)
R = ClusterOutput(merge)

# ==== cluster ENDCODE
format = Format(Format="G53 X{0} Y{1} Z-10", Culture=127, Data0=Slider(140, range=0..10000), Data1=Slider(140, range=0..10000))
panel = Panel("""M5 M9
M30""")
ins = InsertItems(List=panel, Item=format, Indices=1, Wrap=True)  # -> flatten(List)
L = ClusterOutput(ins)

# ==== cluster Cluster
x = ClusterInput()
neg = Negative(Value=x)
G = ClusterInput()
A = ClusterInput()
A_2 = ClusterInput()
L = ClusterInput()
Z = UnitZ(Factor=neg)
division = Division(A=A_2, B=L)
move = Move(Geometry=G, Motion=Z)  # -> graft(Geometry), Transform
division_2 = Division(A=A, B=2)
repeat = RepeatData(Data=division, Length=L)
rad = Radians(Degrees=division_2)
ma = MassAddition(Input=repeat)  # -> Result, graft(PartialResults)
neg_2 = Negative(Value=ma.PartialResults)
Z_2 = UnitZ(Factor=neg_2)  # -> flatten(UnitVector)
tan = Tangent(Value=rad)
move_2 = Move(Geometry=move.Geometry, Motion=Z_2)  # -> Geometry, Transform
multiplication = Multiplication(A=ma.PartialResults, B=tan)
neg_3 = Negative(Value=multiplication)
offset = OffsetCurve(Curve=move_2.Geometry, Distance=flatten(neg_3), Corners=1)
number_slider = Slider(20, range=0..100)
shift = ShiftPaths(Data=offset, Offset=-1)
cull_i = CullIndex(List=shift, Indices=-1, Wrap=True)  # -> simplify(List)
item = ListItem(List=shift, Index=-1, Wrap=True)
pi = Pi(Factor=number_slider)
explode = Explode(Curve=move.Geometry, Recursive=True)  # -> simplify(graft(Segments)), Vertices
explode_2 = Explode(Curve=item, Recursive=True)  # -> simplify(graft(Segments)), Vertices
cull_i_2 = CullIndex(List=explode.Vertices, Indices=0, Wrap=True)
cull_i_3 = CullIndex(List=explode_2.Vertices, Indices=0, Wrap=True)
cir = Circle(Plane=cull_i_3, Radius=number_slider)
trim = TrimWithRegion(Curve=cir, Region=graft(item))  # -> Inside, Outside
len = Length(Curve=trim.Inside)
ln = Line(StartPoint=cull_i_3, EndPoint=cull_i_2)  # -> simplify(Line)
flip = FlipCurve(Curve=ln)  # -> Curve, Flag
ma_2 = MassAddition(Input=len)  # -> Result, PartialResult
shift_2 = ShiftPaths(Data=ma_2.Result, Offset=-1)
larger = LargerThan(FirstNumber=shift_2, SecondNumber=pi)  # -> graft(LargerThan), OrEqualTo
cull = CullPattern(List=graft(ln), CullPattern=invert(simplify(larger.LargerThan)))  # -> simplify(List)
cull_2 = CullPattern(List=graft(flip.Curve), CullPattern=invert(simplify(larger.LargerThan)))  # -> simplify(List)
merge = Merge(Data1=explode_2.Segments, Data2=cull, Data3=cull_2)
shift_3 = ShiftPaths(Data=merge, Offset=-1)
connect = ConnectCurves(Curves=shift_3, Continuity=2, Close=True, Bulge=1)
renumber = RenumberPaths(Data=cull_i)
renumber_2 = RenumberPaths(Data=connect)
merge_2 = Merge(Data1=renumber, Data2=renumber_2)
loft = Loft(
    Curves=[move.Geometry, item],
    Options={Adjust=False, Closed=False, LoftEnds=0, LoftSimp=0, LoftType=0, Rebuild=10, Refit=0.01})
R = ClusterOutput(merge_2)
L_2 = ClusterOutput(loft)

# ==== cluster Cluster_2
enable = ClusterInput()
reset = ClusterInput()
d1 = ClusterInput()
G = ClusterInput()
L = ClusterInput()
i = ClusterInput()
L_2 = ClusterInput()
P = ClusterInput()
L_3 = ClusterInput()
A = ClusterInput()
lng = ListLength(List=L_2)
area = Area(Geometry=G)  # -> Area, Centroid
item = ListItem(List=L, Index=i, Wrap=True)
merge = Merge(Data1=d1, Data2=area.Centroid, Data3=item)  # -> simplify(graft(Result))
data_rec = PythonScript(x=merge, enable=enable, reset=reset, limit=lng)  # -> x; inputs x: tree, enable: Boolean, reset: Boolean, limit: Int32
# ---------- data_rec: Python ----------
from Grasshopper import DataTree
# if not enable : reset = True
if reset or 'rec' not in globals(): rec = DataTree[object]()
record = 0
if enable and not reset: rec.MergeTree(x)
if limit > 0:
    for branch in rec.Branches:
        if branch.Count > limit:
            branch.RemoveRange(0, branch.Count - limit)
x = rec
# ---------- end data_rec ----------
prune = PruneTree(Tree=data_rec, Minimum=1, Maximum=0)
cull_i = CullIndex(List=prune, Indices=Slider(1, range=0..1), Wrap=True)
flip_last = FlipLast(Data=prune)
item_2 = ListItem(List=simplify(flip_last), Index=0, Wrap=True)  # -> Item, Item1, Item2
tstat = TreeStatistics(Tree=item_2.Item1)  # -> Paths, Length, Count
addition = Addition(A=item_2.Item, B=1)
dpath = DeconstructPath(Branch=tstat.Paths)
addition_2 = Addition(A=dpath, B=1)
concat = Concatenate(FragmentA=addition_2, FragmentC="/", FragmentB=lng)
item_3 = ListItem(List=L_3, Index=flatten(item_2.Item), Wrap=True)
end = EndPoints(Curve=item_3)  # -> Start, End
lng_2 = ListLength(List=flatten(end.Start))
equals = Equality(FirstNumber=lng_2, SecondNumber=lng)  # -> Equality, Inequality
smaller = SmallerThan(FirstNumber=lng_2, SecondNumber=lng)  # -> SmallerThan, OrEqualTo
equals_2 = Equality(FirstNumber=A, SecondNumber=6)  # -> Equality, Inequality
and = GateAnd(A=smaller.SmallerThan, B=equals_2.Equality)
and_2 = GateAnd(A=equals.Equality, B=equals_2.Equality)
filter = StreamFilter(Gate=and_2, Stream1=end.Start)

textdot = DefineTextDot(Text=concat, Location=item_2.Item1, Font="Arial", Size=Slider(9, range=0..100))
textdot_2 = DefineTextDot(Text="Select all geometry!", Location=P, Font="Arial", Size=Slider(15, range=0..100))

T = ClusterOutput(textdot)
T_2 = ClusterOutput(textdot_2)
L_4 = ClusterOutput(lng)
R = ClusterOutput(and)
s_0 = ClusterOutput(filter)

# ==== cluster Cluster_3
G = ClusterInput()
B = ClusterInput()
Z = UnitZ(Factor=B)
move = Move(Geometry=G, Motion=Z)  # -> Geometry, Transform
flip = FlipCurve(Curve=move.Geometry)  # -> Curve, Flag
explode = Explode(Curve=flip.Curve, Recursive=True)  # -> Segments, Vertices
arc = CircularArc(explode.Segments)
null = NullItem(Item=arc)  # -> graft(NullFlags), InvalidFlags, Description
dispatch = Dispatch(List=graft(explode.Segments), DispatchPattern=null.NullFlags)  # -> ListA, ListB
prune = PruneTree(Tree=dispatch.ListA, Minimum=1, Maximum=0)
prune_2 = PruneTree(Tree=dispatch.ListB, Minimum=1, Maximum=0)

len = Length(Curve=flip.Curve)  # -> graft(Length)
len_2 = Length(Curve=explode.Segments)
ma = MassAddition(Input=len_2)  # -> Result, PartialResults
dom = ConstructDomain(DomainStart=0, DomainEnd=len)
dom_2 = ConstructDomain(DomainStart=0, DomainEnd=B)
remap = RemapNumbers(Value=ma.PartialResults, Source=dom, Target=dom_2)  # -> Mapped, Clipped
Z_2 = UnitZ(Factor=remap.Mapped)
end = EndPoints(Curve=explode.Segments)  # -> Start, End
neg = Negative(Value=Z_2)
move_2 = Move(Geometry=end.End, Motion=neg)  # -> Geometry, Transform
item = ListItem(List=end.Start, Index=0, Wrap=True)
ins = InsertItems(List=move_2.Geometry, Item=item, Indices=0, Wrap=True)
cull_i = CullIndex(List=ins, Indices=-1, Wrap=True)
ln = Line(StartPoint=cull_i, EndPoint=move_2.Geometry)  # -> simplify(graft(Line))

cull = CullPattern(List=ln, CullPattern=invert(null.NullFlags))
cull_2 = CullPattern(List=ln, CullPattern=null.NullFlags)
end_2 = EndPoints(Curve=cull)  # -> Start, End
prune_3 = PruneTree(Tree=cull_2, Minimum=1, Maximum=0)
prune_4 = PruneTree(Tree=end_2.Start, Minimum=1, Maximum=0)

divide = DivideCurve(Curve=prune_2, Count=Slider(8, range=0..50), Kinks=False)  # -> Points, Tangents, Parameters
shift = ShiftPaths(Data=divide.Parameters, Offset=-1)
shatter = Shatter(Curve=prune_2, Parameters=shift)
shift_2 = ShiftPaths(Data=shatter, Offset=-1)
merge = Merge(Data1=prune, Data2=shift_2)
shift_3 = ShiftPaths(Data=merge, Offset=-1)
len_3 = Length(Curve=shift_3)
lng = ListLength(List=merge)
shift_4 = ShiftPaths(Data=lng, Offset=-1)
ma_2 = MassAddition(Input=len_3)  # -> Result, PartialResults
dom_3 = ConstructDomain(DomainStart=0, DomainEnd=B)
remap_2 = RemapNumbers(Value=ma_2.PartialResults, Source=dom, Target=dom_3)  # -> Mapped, Clipped
end_3 = EndPoints(Curve=shift_3)  # -> Start, End
Z_3 = UnitZ(Factor=remap_2.Mapped)
neg_2 = Negative(Value=Z_3)
move_3 = Move(Geometry=end_3.End, Motion=neg_2)  # -> Geometry, Transform
partition = PartitionList(List=move_3.Geometry, Size=shift_4)
dispatch_2 = Dispatch(List=partition, DispatchPattern=null.NullFlags)  # -> ListA, ListB
prune_5 = PruneTree(Tree=dispatch_2.ListB, Minimum=1, Maximum=0)
ins_2 = InsertItems(List=prune_5, Item=prune_4, Indices=0, Wrap=True)

item_2 = ListItem(List=end_3.Start, Index=0, Wrap=True)

lng_2 = ListLength(List=ins_2)
division = Division(A=lng_2, B=3)
round = Round(Number=division)  # -> Nearest, Floor, Ceiling
series = Series(Start=2, Step=2, Count=round.Floor)
item_3 = ListItem(List=ins_2, Index=series, Wrap=invert(True))
ins_3 = InsertItems(List=ins_2, Item=item_3, Indices=series, Wrap=True)
partition_2 = PartitionList(List=ins_3, Size=3)
item_4 = ListItem(List=partition_2, Index=0, Wrap=True)  # -> Item, Item1, Item2
arc_2 = Arc3Pt(PointA=item_4.Item, PointB=item_4.Item1, PointC=item_4.Item2)  # -> Arc, Plane, Radius
len_4 = Length(Curve=arc_2.Arc)
equals = Equality(FirstNumber=len_4, SecondNumber=0)  # -> Equality, Inequality
cull_3 = CullPattern(List=arc_2.Arc, CullPattern=invert(equals.Equality))
shift_5 = ShiftPaths(Data=cull_3, Offset=-1)

tstat = TreeStatistics(Tree=shift_5)  # -> Paths, Length, Count
tstat_2 = TreeStatistics(Tree=prune_4)  # -> Paths, Length, Count
replace = ReplacePaths(Data=shift_5, Search=tstat.Paths, Replace=tstat_2.Paths)
merge_2 = Merge(Data1=prune_3, Data2=replace)
shift_6 = ShiftPaths(Data=merge_2, Offset=-1)
join = JoinCurves(Curves=shift_6, Preserve=False)
C = ClusterOutput(join)

# ==== cluster Cluster_4
T = ClusterInput()
tstat = TreeStatistics(Tree=T)  # -> Paths, Length, Count
item = ListItem(List=tstat.Paths, Index=0, Wrap=True)
dpath = DeconstructPath(Branch=item)
lng = ListLength(List=dpath)
subtraction = Subtraction(A=lng, B=Slider(1, range=0..1))
neg = Negative(Value=subtraction)
shift = ShiftPaths(Data=T, Offset=neg)
D = ClusterOutput(shift)

# ==== cluster Cluster_5
C = ClusterInput()
explode = Explode(Curve=C, Recursive=True)  # -> Segments, Vertices
len = Length(Curve=explode.Segments)
division = Division(A=len, B=Slider(121, range=1..500))
divide = DivideCurve(Curve=explode.Segments, Count=division, Kinks=False)  # -> Points, Tangents, Parameters
P = ClusterOutput(divide.Points)
shatter = Shatter(Curve=graft(explode.Segments), Parameters=divide.Parameters)
end = EndPoints(Curve=shatter)  # -> Start, End
vec2pt = Vector2Pt(PointA=end.Start, PointB=end.End, Unitize=False)  # -> Vector, Length
align = AlignPlane(Plane=divide.Points, Direction=vec2pt.Vector)  # -> Plane, Angle
cf = ClusterInput()
ce = ClusterInput()
symadv = SymbolAdvanced(
    Style=Slider(9, range=0..20),
    SizePrimary=Slider(2, range=0..10),
    SizeSecondary=Slider(0, range=0..10),
    Rotation=align.Angle,
    Fill=cf,
    Edge=ce,
    Width=2,
    Adjust=False)
D = ClusterOutput(symadv)

# ==== cluster Cluster_6
C = ClusterInput()
explode = Explode(Curve=C, Recursive=True)  # -> Segments, Vertices
python = GhPythonScript(segments=explode.Segments)  # -> out, lines_arcs
# ---------- python: Python ----------
__author__ = "Saha"
__version__ = "2023.04.21"

import rhinoscriptsyntax as rs

if segments:
    try:
        lines_arcs = rs.IsArc(segments) or rs.IsLine(segments)
    except:
        lines_arcs = False
# ---------- end python ----------
unweave = Unweave(List=explode.Segments, UnweavePattern=python.lines_arcs)  # -> Data0, Data1
curve_to_arcs_and_lines = CurveToArcsAndLines(C=unweave.Data0)
weave = Weave(Pattern=python.lines_arcs, Stream0=curve_to_arcs_and_lines, Stream1=unweave.Data1, NullGaps=False)
shift = ShiftPaths(Data=weave, Offset=-1)
connect = ConnectCurves(Curves=weave, Continuity=1, Close=invert(True), Bulge=1)
join = JoinCurves(Curves=shift, Preserve=False)
shift_2 = ShiftPaths(Data=join, Offset=-1)
shift_3 = ShiftPaths(Data=connect, Offset=-1)
null = NullItem(Item=shift_3)  # -> NullFlags, InvalidFlags, Description
weave_2 = Weave(Pattern=null.InvalidFlags, Stream0=shift_3, Stream1=shift_2, NullGaps=False)
W = ClusterOutput(weave_2)

# ==== cluster CenterBetweenPts
L = ClusterInput()
lng = ListLength(List=L)
larger = LargerThan(FirstNumber=lng, SecondNumber=2)  # -> LargerThan, OrEqualTo
gate = StreamGate(Stream=L, Gate=larger.LargerThan)  # -> Target0, Target1
dispatch = Dispatch(List=gate.Target0, DispatchPattern=[True, False])  # -> ListA, ListB
hull = ConvexHull(Points=gate.Target1, Plane=PlaneXY(0, 0, 0))  # -> Hull, HullZ, Indices
ln = Line(StartPoint=dispatch.ListA, EndPoint=dispatch.ListB)
midpt = CurveMiddle(Curve=ln)
area = Area(Geometry=hull.Hull)  # -> Area, Centroid
filter = StreamFilter(Gate=larger.LargerThan, Stream0=midpt, Stream1=area.Centroid)
center = ClusterOutput(filter)

# ==== cluster GeoToGCode
cut_feedrate = ClusterInput()
engage_feedrate = ClusterInput()
number_slider = Slider(3, range=0..5)
C = ClusterInput()
C_2 = ClusterInput()
D = ClusterInput()
layercolor = ClusterInput()
x0 = ClusterInput()
y0 = ClusterInput()
Z = ClusterInput()
pt = ConstructPoint(XCoordinate=x0, YCoordinate=y0, ZCoordinate=Z)
A = ClusterInput()
B = ClusterInput()
end = EndPoints(Curve=C)  # -> Start, End
pdecon = Deconstruct(Point=end.Start)  # -> XComponent, YComponent, ZComponent

clean = CleanTree(RemoveNulls=True, RemoveInvalid=True, RemoveEmpty=False, Tree=flatten(C))  # -> simplify(graft(Tree))
renumber = RenumberPaths(Data=clean)
explode = Explode(Curve=renumber, Recursive=True)  # -> Segments, Vertices
arc = CircularArc(explode.Segments)
null = NullItem(Item=arc)  # -> NullFlags, InvalidFlags, Description
dispatch = Dispatch(List=graft(explode.Segments), DispatchPattern=graft(null.NullFlags))  # -> ListA, ListB
prune = PruneTree(Tree=dispatch.ListA, Minimum=1, Maximum=0)
prune_2 = PruneTree(Tree=dispatch.ListB, Minimum=1, Maximum=0)
lines_to_g_code = LinesToGCODE(C=prune, D=engage_feedrate, d=number_slider, x0=x0, y0=y0)
cluster = Cluster_10(crv=prune_2, D=engage_feedrate, d=number_slider, x0=x0, y0=y0)
merge = Merge(Data1=lines_to_g_code, Data2=cluster)
cluster_2 = Cluster_4(T=merge)

clean_2 = CleanTree(RemoveNulls=True, RemoveInvalid=True, RemoveEmpty=False, Tree=flatten(C_2))  # -> simplify(graft(Tree))
renumber_2 = RenumberPaths(Data=clean_2)
explode_2 = Explode(Curve=renumber_2, Recursive=True)  # -> Segments, Vertices
arc_2 = CircularArc(explode_2.Segments)
null_2 = NullItem(Item=arc_2)  # -> NullFlags, InvalidFlags, Description
dispatch_2 = Dispatch(List=graft(explode_2.Segments), DispatchPattern=graft(null_2.NullFlags))  # -> ListA, ListB
prune_3 = PruneTree(Tree=dispatch_2.ListA, Minimum=1, Maximum=0)
prune_4 = PruneTree(Tree=dispatch_2.ListB, Minimum=1, Maximum=0)
lines_to_g_code_2 = LinesToGCODE(C=prune_3, D=cut_feedrate, d=number_slider, x0=x0, y0=y0)
cluster_3 = Cluster_10(crv=prune_4, D=cut_feedrate, d=number_slider, x0=x0, y0=y0)
merge_2 = Merge(Data1=lines_to_g_code_2, Data2=cluster_3)
cluster_4 = Cluster_4(T=merge_2)

pt_2 = ConstructPoint(XCoordinate=pdecon.XComponent, YCoordinate=pdecon.YComponent, ZCoordinate=Z)
shift = ShiftList(List=pt_2, Shift=1, Wrap=True)
item = ListItem(List=pt_2, Index=0, Wrap=True)  # -> simplify(Item)
pt_3 = Point(item)
ln = Line(StartPoint=pt_2, EndPoint=end.Start)
ln_2 = Line(StartPoint=A, EndPoint=B)
null_3 = NullItem(Item=ln)  # -> NullFlags, InvalidFlags, Description
null_4 = NullItem(Item=ln_2)  # -> NullFlags, InvalidFlags, Description
cull = CullPattern(List=ln, CullPattern=invert(null_3.NullFlags))
cull_2 = CullPattern(List=ln_2, CullPattern=invert(null_4.NullFlags))
end_2 = EndPoints(Curve=cull_2)  # -> Start, End
ln_3 = Line(StartPoint=end_2.End, EndPoint=shift)
cull_i = CullIndex(List=ln_3, Indices=-1, Wrap=True)  # -> simplify(List)
item_2 = ListItem(List=cull_2, Index=-1, Wrap=True)
end_3 = EndPoints(Curve=item_2)  # -> Start, End
pt_4 = Point(end_3.End)
weave = Weave(Pattern=[0, 1], Stream0=pt_3, Stream1=pt_4, NullGaps=False)
entwine = Entwine(Branch00=pt, Branch01=weave, FlattenInputs=True)  # -> flatten(Result)
partition = PartitionList(List=entwine, Size=2)
dispatch_3 = Dispatch(List=partition, DispatchPattern=[True, False])  # -> ListA, ListB
ln_4 = Line(StartPoint=dispatch_3.ListA, EndPoint=dispatch_3.ListB)
cluster_5 = Cluster_8(C=cull, B=engage_feedrate, d=number_slider, x0=x0, y0=y0)  # -> C_2, i
prune_5 = PruneTree(Tree=ln_4, Minimum=1, Maximum=0)
renumber_3 = RenumberPaths(Data=prune_5)
cluster_6 = Cluster_7(C=cull_2, L=cluster_5.i, d=number_slider, x0=x0, y0=y0)
renumber_4 = RenumberPaths(Data=cull_i)
renumber_5 = RenumberPaths(Data=cull_2)
merge_3 = Merge(Data1=renumber_3, Data2=renumber_4, Data3=renumber_5)
panel = Panel(cluster_2)
panel_2 = Panel(cluster_4)
panel_3 = Panel(cluster_6)
panel_4 = Panel(cluster_5.C_2)
graft = GraftTree(Tree=cull, IncludeEmptyLists=True, IncludeNullItems=True)
graft_2 = GraftTree(Tree=cull_2, IncludeEmptyLists=True, IncludeNullItems=True)
renumber_6 = RenumberPaths(Data=panel_4)
renumber_7 = RenumberPaths(Data=panel)
renumber_8 = RenumberPaths(Data=panel_2)
renumber_9 = RenumberPaths(Data=panel_3)
renumber_10 = RenumberPaths(Data=graft)
renumber_11 = RenumberPaths(Data=graft_2)
L = ClusterOutput(cull_2)
L_2 = ClusterOutput(cull)
L_3 = ClusterOutput(cull_i)
D_2 = ClusterOutput(renumber_3)
merge_4 = Merge(Data1=renumber_10, Data2=renumber, Data3=renumber_2, Data4=renumber_11)
merge_5 = Merge(Data1=renumber_6, Data2=renumber_7, Data3=renumber_8, Data4=renumber_9)
geometry = ClusterOutput(merge_4)
R = ClusterOutput(merge_5)
len = Length(Curve=C_2)  # -> flatten(Length)
len_2 = Length(Curve=merge_3)  # -> flatten(Length)
len_3 = Length(Curve=C)  # -> flatten(Length)
len_4 = Length(Curve=cull)  # -> flatten(Length)
ma = MassAddition(Input=len)  # -> Result, PartialResults
ma_2 = MassAddition(Input=len_2)  # -> Result, PartialResults
ma_3 = MassAddition(Input=len_3)  # -> Result, PartialResults
ma_4 = MassAddition(Input=len_4)  # -> Result, PartialResults
division = Division(A=ma.Result, B=cut_feedrate)
division_2 = Division(A=ma_2.Result, B=Slider(10000, range=0..100000))
division_3 = Division(A=ma_3.Result, B=engage_feedrate)
division_4 = Division(A=ma_4.Result, B=engage_feedrate)
panel_5 = Panel(ma_2.Result)
panel_6 = Panel(ma_3.Result)
panel_7 = Panel(ma_4.Result)
panel_8 = Panel(ma.Result)
merge_6 = Merge(Data1=division, Data2=division_2, Data3=division_3, Data4=division_4)
renumber_12 = RenumberPaths(Data=D)
renumber_13 = RenumberPaths(Data=layercolor)
ma_5 = MassAddition(Input=merge_6)  # -> Result, PartialResults
merge_7 = Merge(Data1=ma_5.Result, Data2=renumber_12, Data3=renumber_13)
R_2 = ClusterOutput(merge_7)

# ==== cluster Pocketing
A = ClusterInput()
_1 = ClusterInput()
cf = ClusterInput()
of = ClusterInput()
cut_direction = ClusterInput()
A_2 = ClusterInput()
clean_islands = ClusterInput()
bit_dia = ClusterInput()
equals = Equality(FirstNumber=A, SecondNumber=3)  # -> Equality, Inequality
filter = StreamFilter(Gate=equals.Equality, Stream1=_1)

polyoffset = PolylineOffset(
    Polylines=filter,
    Distance=bit_dia,
    Plane=Plane(origin=(0, 0, 0), x=(0, 0, 0), y=(0, 0, 0)),
    Tolerance=0.001,
    ClosedFillet=cf,
    OpenFillet=of,
    Miter=0)  # -> Contour, simplify(Holes)
polyboolean = PolylineBoolean(
    A=polyoffset.Contour,
    B=polyoffset.Holes,
    BooleanType=0,
    Plane=Plane(origin=(0, 0, 0), x=(0, 0, 0), y=(0, 0, 0)),
    Tolerance=0.001,
    EvenOdd=True)
graft = GraftTree(Tree=polyboolean, IncludeEmptyLists=True, IncludeNullItems=True)

graft_2 = GraftTree(Tree=filter, IncludeEmptyLists=True, IncludeNullItems=True)
cluster = Cluster_11(T=graft)
cluster_2 = Cluster_13(C=graft_2, D=A_2)
c2offset = Clipper2Offset(Polylines=cluster, Distance=cluster_2, JoinType=3, EndType=3, MiterLimit=2, Precision=4, SVGHeight=600, SVGWidth=800)  # -> Holes, Outer, ClipperPath
polyoffset_2 = PolylineOffset(
    Polylines=polyboolean,
    Distance=cluster_2,
    Plane=Plane(origin=(0, 0, 0), x=(0, 0, 0), y=(0, 0, 0)),
    Tolerance=0.001,
    ClosedFillet=cf,
    OpenFillet=of,
    Miter=0)  # -> Contour, simplify(Holes)
polyboolean_2 = PolylineBoolean(
    A=c2offset.Holes,
    B=c2offset.Outer,
    BooleanType=0,
    Plane=Plane(origin=(0, 0, 0), x=(0, 0, 0), y=(0, 0, 0)),
    Tolerance=0.001,
    EvenOdd=True)
c2bool = Clipper2Boolean(PolylineA=c2offset.Holes, PolylineB=c2offset.Outer, Operation=2, Precision=4)
cluster_3 = Cluster_11(T=polyboolean_2)
group_geo_in_geo = CheckCollisions(G=filter, S=cluster_3)
cluster_4 = Cluster_11(T=group_geo_in_geo)
merge = Merge(Data1=cluster, Data2=cluster_4)

cir = Circle(Plane=PlaneXY(0, 0, 0), Radius=1)
flip = FlipCurve(Curve=cir)  # -> Curve, Flag
filter_2 = StreamFilter(Gate=cut_direction, Stream0=flip.Curve, Stream1=cir)
flip_2 = FlipCurve(Curve=merge, Guide=graft(filter_2))  # -> Curve, Flag

pocket_clean_islands = PocketCleanIslands(G=clean_islands, D=flip_2.Curve, D_2=bit_dia, crv=cluster)

# ----
# Rewrite this block!!! Works correct time to time
# Connect set of closed curves
# Sort direction from the inside to outside
# prevent collisions between
# connection lines and geometry
# that needs to be untouched
connect = Connect(A=A_2, B=pocket_clean_islands)

check_collisions = CheckCollisions(G=filter, S=flatten(connect))
T = ClusterInput()
shift = ShiftPaths(Data=check_collisions, Offset=-1)

polyoffset_3 = PolylineOffset(
    Polylines=check_collisions,
    Distance=bit_dia,
    Plane=Plane(origin=(0, 0, 0), x=(0, 0, 0), y=(0, 0, 0)),
    Tolerance=0.001,
    ClosedFillet=0,
    OpenFillet=1,
    Miter=2)  # -> Contour, Holes
move = Move(Geometry=shift, Motion=T)  # -> Geometry, Transform
polyboolean_3 = PolylineBoolean(
    A=polyoffset_3.Contour,
    B=polyoffset_3.Holes,
    BooleanType=2,
    Plane=Plane(origin=(0, 0, 0), x=(0, 0, 0), y=(0, 0, 0)),
    Tolerance=0.001,
    EvenOdd=True)
boundary = BoundarySurfaces(Edges=polyboolean_3)

polyoffset_4 = PolylineOffset(
    Polylines=polyoffset_3.Holes,
    Distance=Slider(0.1, range=0..1),
    Plane=Plane(origin=(0, 0, 0), x=(0, 0, 0), y=(0, 0, 0)),
    Tolerance=0.001,
    ClosedFillet=0,
    OpenFillet=1,
    Miter=2)  # -> Contour, Holes
crv = Curve(simplify(polyoffset_4.Holes))
boundary_2 = BoundarySurfaces(Edges=crv)
S = ClusterOutput(boundary)
A_3 = ClusterOutput(check_collisions)
G = ClusterOutput(move.Geometry)
crv_2 = ClusterOutput(crv)
S_2 = ClusterOutput(boundary_2)

# ==== cluster SortGroups
T = ClusterInput()
tstat = TreeStatistics(Tree=T)  # -> Paths, Length, Count
larger = LargerThan(FirstNumber=tstat.Length, SecondNumber=1)  # -> graft(LargerThan), OrEqualTo
unweave = Unweave(List=T, UnweavePattern=larger.LargerThan)  # -> Data0, Data1
split = SplitList(List=unweave.Data1, Index=1)  # -> ListA, ListB
sort_crv = SortByCurve(Curves=split.ListB, Guide=split.ListA, Parameter=0.5)  # -> Curves, Indices
shift = ShiftPaths(Data=sort_crv.Curves, Offset=-1)
merge = Merge(Data1=split.ListA, Data2=shift)
weave = Weave(Pattern=larger.LargerThan, Stream0=unweave.Data0, Stream1=merge, NullGaps=False)
weave_2 = Weave(Pattern=larger.LargerThan, Stream0=unweave.Data0, Stream1=split.ListA, NullGaps=False)
end = EndPoints(Curve=weave_2)  # -> Start, End
renumber = RenumberPaths(Data=weave)
renumber_2 = RenumberPaths(Data=end.Start)
shift_2 = ShiftPaths(Data=renumber, Offset=-1)
shift_3 = ShiftPaths(Data=renumber_2, Offset=-1)
D = ClusterOutput(renumber)
D_2 = ClusterOutput(shift_3)

# ==== cluster ReMachining
A = ClusterInput()

# ---- group: Data 1
_1 = ClusterInput()

# ----
relay = ClusterInput()
A_2 = ClusterInput()
A_3 = ClusterInput()
T = ClusterInput()
equals = Equality(FirstNumber=A, SecondNumber=6)  # -> Equality, Inequality
filter = StreamFilter(Gate=equals.Equality, Stream1=_1)
crv = Curve(graft(filter))
division = Division(A=A_2, B=2)
disc = Discontinuity(Curve=crv, Level=1)  # -> Points, Parameters
lng = ListLength(List=disc.Points)
larger = LargerThan(FirstNumber=lng, SecondNumber=0)  # -> LargerThan, OrEqualTo
unweave = Unweave(List=crv, UnweavePattern=larger.LargerThan)  # -> Data0, Data1
prune = PruneTree(Tree=unweave.Data1, Minimum=1, Maximum=0)
topoly = CurveToPolyline(Curve=prune, ToleranceDistance=0, ToleranceAngle=0)  # -> Polyline, Segments
pcen = PolygonCenter(Polyline=topoly.Polyline)  # -> CenterV, CenterE, CenterA
disc_2 = Discontinuity(Curve=topoly.Polyline, Level=1)  # -> Points, Parameters
side = CurveSide(Curve=topoly.Polyline, Point=pcen.CenterE)  # -> Side, Left, Right
cir = Circle(Plane=disc_2.Points, Radius=relay)
trim = TrimWithRegion(Curve=cir, Region=prune)  # -> Inside, Outside
len = Length(Curve=trim.Inside)
len_2 = Length(Curve=trim.Outside)
division_2 = Division(A=len, B=relay)
division_3 = Division(A=len_2, B=relay)
hypot = Expression(x=relay, y=division_2, Expression="2 * x * sin(y/2)")
catet = Expression(x=relay, y=division_2, Expression="x / tan(y/2)")
catet_2 = Expression(x=relay, y=division_3, Expression="x / tan(y/2)")
shift = ShiftPaths(Data=simplify(catet), Offset=-1)
shift_2 = ShiftPaths(Data=simplify(catet_2), Offset=-1)
smaller = SmallerThan(FirstNumber=shift, SecondNumber=0)  # -> SmallerThan, OrEqualTo
smaller_2 = SmallerThan(FirstNumber=shift_2, SecondNumber=0)  # -> SmallerThan, OrEqualTo
cull = CullPattern(List=disc_2.Points, CullPattern=invert(smaller.OrEqualTo))
cull_2 = CullPattern(List=shift, CullPattern=invert(smaller.OrEqualTo))
cull_3 = CullPattern(List=disc_2.Points, CullPattern=invert(smaller_2.OrEqualTo))
cull_4 = CullPattern(List=shift_2, CullPattern=invert(smaller_2.OrEqualTo))
division_4 = Division(A=cull_2, B=2)
panel = Panel(cull_2)
panel_2 = Panel(cull_4)
cir_2 = Circle(Plane=cull_3, Radius=cull_4)
cir_3 = Circle(Plane=cull, Radius=division_4)
trim_2 = TrimWithRegion(Curve=prune, Region=cir_2)  # -> Inside, Outside
trim_3 = TrimWithRegion(Curve=prune, Region=cir_3)  # -> Inside, Outside
division_5 = Division(A=relay, B=Slider(1.1, range=0..10))
shift_3 = ShiftPaths(Data=trim_2.Inside, Offset=-1)
shift_4 = ShiftPaths(Data=trim_3.Inside, Offset=-1)
fillet = Fillet(Curve=prune, Radius=division_5)
dispatch = Dispatch(List=fillet, DispatchPattern=side.Right)  # -> ListA, ListB
dispatch_2 = Dispatch(List=shift_4, DispatchPattern=side.Right)  # -> ListA, ListB
neg = Negative(Value=division)
dispatch_3 = Dispatch(List=shift_3, DispatchPattern=side.Right)  # -> ListA, ListB
offset = OffsetCurve(Curve=dispatch_3.ListA, Distance=neg, Corners=1)
offset_2 = OffsetCurve(Curve=dispatch.ListA, Distance=division, Corners=1)
end = EndPoints(Curve=dispatch_2.ListB)  # -> Start, End
end_2 = EndPoints(Curve=offset)  # -> Start, End
ln = Line(StartPoint=end.Start, EndPoint=end.End)
ln_2 = Line(StartPoint=end_2.Start, EndPoint=end_2.End)
join = JoinCurves(Curves=[dispatch_2.ListB, ln], Preserve=False)
join_2 = JoinCurves(Curves=[offset, ln_2], Preserve=False)
topoly_2 = CurveToPolyline(Curve=join, ToleranceDistance=0, ToleranceAngle=0)  # -> Polyline, Segments
shift_5 = ShiftPaths(Data=simplify(join_2), Offset=-1)
pcen_2 = PolygonCenter(Polyline=topoly_2.Polyline)  # -> CenterV, CenterE, CenterA
side_2 = CurveSide(Curve=dispatch_2.ListB, Point=pcen_2.CenterE)  # -> Side, Left, Right
trim_4 = TrimWithRegion(Curve=offset_2, Region=shift_5)  # -> Inside, Outside
trim_5 = TrimWithRegion(Curve=shift_5, Region=offset_2)  # -> Inside, Outside
cir_4 = Circle(Plane=PlaneXY(0, 0, 0), Radius=1)
join_3 = JoinCurves(Curves=[trim_5.Inside, trim_4.Inside], Preserve=False)  # -> simplify(Curves)
dispatch_4 = Dispatch(List=cir_4, DispatchPattern=side_2.Left)  # -> ListA, ListB
flip = FlipCurve(Curve=dispatch_2.ListB, Guide=dispatch_4.ListA)  # -> Curve, Flag
shift_6 = ShiftPaths(Data=simplify(join_3), Offset=-1)
repeat = RepeatData(Data=division, Length=Slider(7, range=0..10))
offset_3 = OffsetCurve(Curve=flip.Curve, Distance=neg, Corners=1)
ma = MassAddition(Input=repeat)  # -> Result, PartialResults
clean = CleanTree(RemoveNulls=True, RemoveInvalid=True, RemoveEmpty=invert(False), Tree=shift_6)
end_3 = EndPoints(Curve=offset_3)  # -> Start, End
ln_3 = Line(StartPoint=end_3.Start, EndPoint=end_3.End)
polyoffset = PolylineOffset(
    Polylines=clean,
    Distance=ma.PartialResults,
    Plane=Plane(origin=(0, 0, 0), x=(0, 0, 0), y=(0, 0, 0)),
    Tolerance=0.001,
    ClosedFillet=0,
    OpenFillet=0,
    Miter=2)  # -> Contour, Holes
join_4 = JoinCurves(Curves=[offset_3, ln_3], Preserve=False)
shift_7 = ShiftPaths(Data=simplify(polyoffset.Holes), Offset=-1)
clean_2 = CleanTree(RemoveNulls=True, RemoveInvalid=True, RemoveEmpty=invert(False), Tree=join_4)  # -> simplify(Tree)
cluster = Cluster_4(T=clean_2)
polyoffset_2 = PolylineOffset(
    Polylines=cluster,
    Distance=ma.PartialResults,
    Plane=Plane(origin=(0, 0, 0), x=(0, 0, 0), y=(0, 0, 0)),
    Tolerance=0.001,
    ClosedFillet=0,
    OpenFillet=0,
    Miter=2)  # -> Contour, Holes
shift_8 = ShiftPaths(Data=simplify(polyoffset_2.Holes), Offset=-1)
merge = Merge(Data1=cluster, Data2=shift_8, Data3=clean, Data4=shift_7)
clean_3 = CleanTree(RemoveNulls=True, RemoveInvalid=True, RemoveEmpty=invert(False), Tree=merge)
pocketoffset_connection = PocketOffsetConnection(A=A_3, B=clean_3)
shift_9 = ShiftPaths(Data=pocketoffset_connection, Offset=-1)
polyoffset_3 = PolylineOffset(
    Polylines=pocketoffset_connection,
    Distance=division,
    Plane=Plane(origin=(0, 0, 0), x=(0, 0, 0), y=(0, 0, 0)),
    Tolerance=0.001,
    ClosedFillet=0,
    OpenFillet=1,
    Miter=2)  # -> Contour, Holes
shift_10 = ShiftPaths(Data=pocketoffset_connection, Offset=-1)
move = Move(Geometry=shift_9, Motion=T)  # -> Geometry, Transform
graft = GraftTree(Tree=shift_10, IncludeEmptyLists=True, IncludeNullItems=True)
polyboolean = PolylineBoolean(
    A=polyoffset_3.Contour,
    B=polyoffset_3.Holes,
    BooleanType=2,
    Plane=Plane(origin=(0, 0, 0), x=(0, 0, 0), y=(0, 0, 0)),
    Tolerance=0.001,
    EvenOdd=True)
T_2 = ClusterOutput(graft)
G = ClusterOutput(move.Geometry)
boundary = BoundarySurfaces(Edges=polyboolean)
S = ClusterOutput(boundary)

# ==== cluster ChangeCurveSeam
G = ClusterInput()
crv = ClusterInput()
crv_2 = ClusterInput()
crv_3 = Curve(crv)
crv_4 = Curve(crv_2)
graft = GraftTree(Tree=crv_3, IncludeEmptyLists=True, IncludeNullItems=True)
bbox = GhPythonScript(object=graft)  # -> out, box, X, Y, Max, Min, Rect
# ---------- bbox: Python ----------
import rhinoscriptsyntax as rs

if object:
    box = rs.BoundingBox(object)
    if box:
        X = rs.Distance(box[0], box[1])
        Y = rs.Distance(box[1], box[2])
        Max = max(X,Y)
        Min = min(X,Y)
        plane = rs.WorldXYPlane()
        plane = rs.MovePlane(plane,box[0])
        Rect = rs.AddRectangle(plane, X, Y)
# ---------- end bbox ----------
end = EndPoints(Curve=crv_4)  # -> Start, End
clean = CleanTree(RemoveNulls=True, RemoveInvalid=True, RemoveEmpty=False, Tree=bbox.Rect)
box_corners = BoxCorners(Box=clean)  # -> CornerA, CornerB, CornerC, CornerD, CornerE, CornerF, CornerG, CornerH
filter = StreamFilter(
    Gate=G,
    Stream0=box_corners.CornerA,
    Stream1=box_corners.CornerB,
    Stream2=box_corners.CornerC,
    Stream3=box_corners.CornerD,
    Stream4=end.Start)
crv_cp = CurveClosestPoint(Point=filter, Curve=graft)  # -> Point, Parameter, Distance
sort = SortList(Keys=crv_cp.Distance, ValuesA=crv_cp.Parameter, ValuesB=crv_cp.Point)  # -> Keys, ValuesA, ValuesB
cls = Closed(Curve=graft)  # -> Closed, Periodic
item = ListItem(List=sort.ValuesA, Index=0, Wrap=True)
unweave = Unweave(List=graft, UnweavePattern=cls.Periodic)  # -> Data0, Data1
seam = Seam(Curve=unweave.Data1, Seam=item)
shatter = Shatter(Curve=unweave.Data0, Parameters=item)
weave = Weave(Pattern=cls.Periodic, Stream0=shatter, Stream1=seam, NullGaps=False)
tstat = TreeStatistics(Tree=weave)  # -> Paths, Length, Count
tstat_2 = TreeStatistics(Tree=crv_3)  # -> Paths, Length, Count
dpath = DeconstructPath(Branch=tstat.Paths)
dpath_2 = DeconstructPath(Branch=tstat_2.Paths)
lng = ListLength(List=dpath)  # -> flatten(Length)
lng_2 = ListLength(List=dpath_2)  # -> flatten(Length)
item_2 = ListItem(List=lng, Index=0, Wrap=True)
item_3 = ListItem(List=lng_2, Index=0, Wrap=True)
subtraction = Subtraction(A=item_3, B=item_2)
shift = ShiftPaths(Data=weave, Offset=subtraction)  # -> simplify(Data)
tstat_3 = TreeStatistics(Tree=shift)  # -> Paths, Length, Count
replace = ReplacePaths(Data=shift, Search=tstat_3.Paths, Replace=tstat_2.Paths)
crv_5 = ClusterOutput(replace)

# ==== cluster Cluster_15
crv = ClusterInput()
relay = ClusterInput()
A = ClusterInput()
crv_2 = Curve(crv)
equals = Equality(FirstNumber=A, SecondNumber=2)  # -> Equality, Inequality
cls = Closed(Curve=crv_2)  # -> Closed, Periodic
dispatch = Dispatch(List=crv_2, DispatchPattern=cls.Closed)  # -> ListA, ListB
filter = StreamFilter(Gate=equals.Equality, Stream0=relay, Stream1=0)
gate = StreamGate(Stream=dispatch.ListA, Gate=filter)  # -> Target0, Target1
boundary = BoundarySurfaces(Edges=gate.Target1)
edges = BrepEdges(Brep=boundary)  # -> Naked, Interior, NonManifold
join = JoinCurves(Curves=edges.Naked, Preserve=False)  # -> simplify(Curves)
area = Area(Geometry=join)  # -> Area, Centroid
sort = SortList(Keys=area.Area)  # -> reverse(Keys), ValuesA
item = ListItem(List=sort.Keys, Index=0, Wrap=True)
mindex = MemberIndex(Set=area.Area, Member=item)  # -> Index, Count
item_2 = ListItem(List=join, Index=mindex.Index, Wrap=True)
cull_i = CullIndex(List=join, Indices=mindex.Index, Wrap=True)
shift = ShiftPaths(Data=cull_i, Offset=-1)
filter_2 = StreamFilter(Gate=filter, Stream0=gate.Target0, Stream1=item_2)
renumber = RenumberPaths(Data=filter_2)
renumber_2 = RenumberPaths(Data=shift)
flatten = FlattenTree(Tree=dispatch.ListB, Path="{0}")
join_2 = JoinCurves(Curves=flatten, Preserve=False)
outside = ClusterOutput(renumber)
inside = ClusterOutput(renumber_2)
open = ClusterOutput(join_2)
panel = Panel(renumber_2)

# ==== cluster Cluster_16
L = ClusterInput()
C = ClusterInput()
relay = ClusterInput()
neg = Negative(Value=relay)
dom = ConstructDomain(DomainStart=neg, DomainEnd=relay)
runion = RegionUnion(Curves=C)
boxrec = BoxRectangle(Rectangle=runion, Height=dom)
Z = UnitZ(Factor=relay)
neg_2 = Negative(Value=Z)
extr = Extrude(Base=graft(runion), Direction=[Z, neg_2])
join = BrepJoin(Breps=extr)  # -> Breps, Closed
cap = CapHoles(Brep=join.Breps)
shapein = ShapeInBrep(Brep=cap, Shape=L)
unweave = Unweave(List=L, UnweavePattern=shapein)  # -> flatten(Data0), flatten(Data1), Data2
clean = CleanTree(RemoveNulls=True, RemoveInvalid=True, RemoveEmpty=False, Tree=[unweave.Data0, unweave.Data1])
geoattributes = GhPythonScript(G=clean)  # -> out, FL, L, C, GFL, GL, GC, GF; inputs G: list of Guid, F: Boolean
# ---------- geoattributes: Python ----------
import Rhino 
import rhinoscriptsyntax as rs
import scriptcontext as sc


sc.doc = Rhino.RhinoDoc.ActiveDoc

def geo_attrs(geo):
    """get referenced geometry attributes
    input:
        referenced geometry
    output:
        dict with geometry attributes as keys, such as 'layer' and 'color'
    """
    if geo is not None:
        geo_layer = rs.ObjectLayer(geo)
        geo_color = rs.LayerColor(geo_layer)
    return {"layer": geo_layer, "color": geo_color}

# F - toggle to filter geometry and attributes by layer or not if 
FL = sc.doc.Layers # full layernames in current document
L = [str(l).split("::")[-1] for l in FL] # layernames in current document
C = [lc.Color for lc in FL] # layer colors in current document
GC = [] # selected geometry layer color
GL = [] # selected geometry layer
GFL = [] # selected geometry full layer name
GF = [] # layer name to filter selected geometry

if G:
    if LF is None: # LF as LayerFilter, to filter geometry by LayerName
        if not F: # if LF not assigned, choose whether show geo attrs without layer filter or not
            GF = G
            for geo in G:
                GFL.append(geo_attrs(geo)["layer"])
                GL.append(geo_attrs(geo)["layer"].split("::")[-1])
                GC.append(geo_attrs(geo)["color"])
    else:
        for geo in G:
            if geo_attrs(geo)["layer"] == LF:
                if geo_attrs(geo)["layer"] not in GFL:
                    GFL.append(geo_attrs(geo)["layer"])
                    GL.append(geo_attrs(geo)["layer"].split("::")[-1])
                    GC.append(geo_attrs(geo)["color"])
                if geo not in rs.HiddenObjects():
                    GF.append(geo)

sc.doc = ghdoc #important, set it back to default
# ---------- end geoattributes ----------
txt = Text(geoattributes.FL)
txt_2 = Text(geoattributes.GFL)
cset = CreateSet(List=txt_2)  # -> Set, Map
split = TextSplit(Text=cset.Set, Separators="::")
mindex = MemberIndex(Set=txt, Member=cset.Set)  # -> flatten(Index), Count
item = ListItem(List=split, Index=-1, Wrap=True)  # -> flatten(Item)
tsort = SortText(Keys=item, Values=mindex.Index, Culture=127)  # -> Keys, Values
ghpython_script = GhPythonScript(ln=tsort.Keys)  # -> out, bit, start_depth, end_depth, operation, sorting, remachining
# ---------- ghpython_script: Python ----------
__author__ = "jesterKing"

import re
bit = None
depth = None
start_depth = None
end_depth = None
operation = None
sorting = None
operations = {"SN":0,"VN":1,"VD":2,"VB":3,"GR":4, "SV":5, "RE":6}
sortings = {"DU":1,"UD":2,"LR":3,"RL":4}


if ln:
    p = re.compile("(?P<bit>\w*?)(?:_|__)(?P<depth>[^_]\w*?MM)_(?P<operation>\w*)")
    m = p.match(ln)
    if m:
        bit = m.group("bit")
        depth = m.group("depth")
        depth = depth.replace('_', '.').lstrip('N').rstrip('MM').split('K')[::-1]
        if len(depth) > 1:
            start_depth = depth[1]
        end_depth = depth[0]
        operation = m.group("operation")
        operation = operation.split('_')
        
        if len(operation) > 1:
            sorting = sortings.get(operation[1])
            for op in operation:
                if "RE" in op:
                    remachining = op.lstrip("RE")
        if "RE" in operation[0]:
            operation[0] == "RE"
            remachining = operation[0].lstrip("RE")
            operation = operations.get(operation[0][:2])
        else: 
            operation = operations.get(operation[0])
# ---------- end ghpython_script ----------
cset_2 = CreateSet(List=ghpython_script.bit)  # -> Set, Map
cset_3 = CreateSet(List=ghpython_script.bit)  # -> Set, Map
graft = GraftTree(Tree=tsort.Keys, IncludeEmptyLists=True, IncludeNullItems=True)
graft_2 = GraftTree(Tree=ghpython_script.end_depth, IncludeEmptyLists=True, IncludeNullItems=True)
graft_3 = GraftTree(Tree=tsort.Values, IncludeEmptyLists=True, IncludeNullItems=True)
path = ConstructPath(Indices=graft(cset_2.Map))  # -> flatten(Branch)
path_2 = ConstructPath(Indices=graft(cset_3.Map))  # -> flatten(Branch)
# Sorting by:
# 1 Layer name ASC
# 2 Depth of cut DESC
tstat = TreeStatistics(Tree=graft)  # -> Paths, Length, Count
tstat_2 = TreeStatistics(Tree=graft_2)  # -> Paths, Length, Count
tstat_3 = TreeStatistics(Tree=graft_3)  # -> Paths, Length, Count
replace = ReplacePaths(Data=graft, Search=tstat.Paths, Replace=path)
replace_2 = ReplacePaths(Data=graft_2, Search=tstat_2.Paths, Replace=path_2)
replace_3 = ReplacePaths(Data=graft_3, Search=tstat_3.Paths, Replace=path)
sort = SortList(Keys=replace_2, ValuesA=replace, ValuesB=replace_3)  # -> Keys, reverse(ValuesA), reverse(ValuesB)
item_2 = ListItem(List=txt, Index=sort.ValuesB, Wrap=True)
flatten = FlattenTree(Tree=sort.ValuesA, Path="{0}")
flatten_2 = FlattenTree(Tree=item_2, Path="{0}")
T = ClusterOutput(clean)
T_2 = ClusterOutput(flatten)
T_3 = ClusterOutput(flatten_2)

# ==== cluster CurveToArcsAndLines
C = ClusterInput()
pltolinearc = PolylineToLinesAndArcs(Curve=C, Tolerance=0.01)  # -> Polyline, PolyCurve
cls = Closed(Curve=pltolinearc.PolyCurve)  # -> Closed, Periodic
end = EndPoints(Curve=C)  # -> Start, End
dispatch = Dispatch(List=pltolinearc.PolyCurve, DispatchPattern=cls.Closed)  # -> ListA, ListB
dispatch_2 = Dispatch(List=end.Start, DispatchPattern=cls.Closed)  # -> ListA, ListB
crv_cp = CurveClosestPoint(Point=flatten(dispatch_2.ListA), Curve=dispatch.ListA)  # -> Point, Parameter, Distance
sort = SortList(Keys=crv_cp.Distance, ValuesA=crv_cp.Parameter, ValuesB=crv_cp.Point)  # -> Keys, ValuesA, ValuesB
item = ListItem(List=sort.ValuesA, Index=0, Wrap=True)
seam = Seam(Curve=dispatch.ListA, Seam=item)
merge = Merge(Data1=dispatch.ListB, Data2=seam)
R = ClusterOutput(merge)

# ==== cluster Cluster_7
C = ClusterInput()
L = ClusterInput()
d = ClusterInput()
x0 = ClusterInput()
y0 = ClusterInput()
topoly = CurveToPolyline(Curve=flatten(C), ToleranceDistance=0, ToleranceAngle=0)  # -> Polyline, Segments
explode = Explode(Curve=topoly.Polyline, Recursive=True)  # -> Segments, Vertices
lng = ListLength(List=explode.Vertices)
item = ListItem(List=explode.Vertices, Index=expr("x-1", lng), Wrap=True)
pdecon = Deconstruct(Point=item)  # -> XComponent, YComponent, ZComponent

subtraction = Subtraction(A=pdecon.XComponent, X0=x0)
subtraction_2 = Subtraction(A=pdecon.YComponent, Y0=y0)

round_to_decimal_place = GhPythonScript(X=subtraction, Y=subtraction_2, Z=pdecon.ZComponent, d=d)  # -> rX, rY, rZ, rI, rJ; inputs X: list, Y: list, Z: list, I: list, J: list, d: Int32
# ---------- round_to_decimal_place: Python ----------
import rhinoscriptsyntax as rs

def round_to_decimal(item, dec=0):
    rounded = []
    if dec is None: dec = 0
    if item:
        for i in item:
            rounded.append(round(i, dec))
    return rounded

rX = round_to_decimal(X, d)
rY = round_to_decimal(Y, d)
rZ = round_to_decimal(Z, d)
rI = round_to_decimal(I, d)
rJ = round_to_decimal(J, d)
# ---------- end round_to_decimal_place ----------
lng_2 = ListLength(List=L)
stack = StackData(Data="G0", Stack=lng_2)  # -> simplify(Data)
format = Format(Format="Y{0}", Culture=127, Data0=round_to_decimal_place.rY)  # -> simplify(graft(Text))
format_2 = Format(Format="X{0}", Culture=127, Data0=round_to_decimal_place.rX)  # -> simplify(graft(Text))
format_3 = Format(Format="Z{0}", Culture=127, Data0=round_to_decimal_place.rZ)  # -> simplify(Text)
renumber = RenumberPaths(Data=stack)
renumber_2 = RenumberPaths(Data=format_2)
renumber_3 = RenumberPaths(Data=format)
renumber_4 = RenumberPaths(Data=format_3)
merge = Merge(Data1=renumber, Data2=renumber_2, Data3=renumber_3, Data4=renumber_4)
join = TextJoin(Text=merge, Join=" ")  # -> simplify(Result)
lng_3 = ListLength(List=item)
partition = PartitionList(List=join, Size=lng_3)  # -> simplify(Chunks)
C_2 = ClusterOutput(partition)

# ==== cluster LinesToGCODE
number_slider = Slider(3, range=0..5)
C = ClusterInput()
D = ClusterInput()
d = ClusterInput()
x0 = ClusterInput()
y0 = ClusterInput()
end = EndPoints(Curve=C)  # -> Start, End
pt = Point(end.End)
pdecon = Deconstruct(Point=pt)  # -> XComponent, YComponent, ZComponent
subtraction = Subtraction(A=pdecon.XComponent, X0=x0)
subtraction_2 = Subtraction(A=pdecon.YComponent, Y0=y0)
lng = ListLength(List=pt)
lng_2 = ListLength(List=pt)
round_to_decimal_place = GhPythonScript(X=subtraction, Y=subtraction_2, Z=pdecon.ZComponent, d=d)  # -> rX, rY, rZ, rI, rJ; inputs X: list, Y: list, Z: list, I: list, J: list, d: Int32; same code as round_to_decimal_place
stack = StackData(Data=D, Stack=lng)
stack_2 = StackData(Data="1", Stack=lng_2)
format = Format(
    Format="G{0} X{1} Y{2} Z{3} F{4}",
    Culture=127,
    Data0=stack_2,
    Data1=round_to_decimal_place.rX,
    Data2=round_to_decimal_place.rY,
    Data3=round_to_decimal_place.rZ,
    Data4=stack)
lng_3 = ListLength(List=flatten(C))
bool = Boolean(lng_3)
filter = StreamFilter(Gate=bool, Stream1=format)
s_1 = ClusterOutput(filter)

# ==== cluster Cluster_8
C = ClusterInput()
B = ClusterInput()
d = ClusterInput()
x0 = ClusterInput()
y0 = ClusterInput()
topoly = CurveToPolyline(Curve=C, ToleranceDistance=0, ToleranceAngle=0)  # -> Polyline, Segments
explode = Explode(Curve=topoly.Polyline, Recursive=True)  # -> Segments, Vertices
item = ListItem(List=explode.Vertices, Index=0, Wrap=True)
pdecon = Deconstruct(Point=explode.Vertices)  # -> XComponent, YComponent, ZComponent
concat = Concatenate(FragmentA=" F", FragmentB=B)

subtraction = Subtraction(A=pdecon.XComponent, X0=x0)
subtraction_2 = Subtraction(A=pdecon.YComponent, Y0=y0)

merge = Merge(Data2=concat)
round_to_decimal_place = GhPythonScript(X=subtraction, Y=subtraction_2, Z=pdecon.ZComponent, d=d)  # -> rX, rY, rZ, rI, rJ; inputs X: list, Y: list, Z: list, I: list, J: list, d: Int32; same code as round_to_decimal_place
panel = Panel(merge)
format = Format(Format="X{0}", Culture=127, Data0=round_to_decimal_place.rX)  # -> simplify(Text)
format_2 = Format(Format="Y{0}", Culture=127, Data0=round_to_decimal_place.rY)  # -> simplify(Text)
format_3 = Format(Format="Z{0}", Culture=127, Data0=round_to_decimal_place.rZ)  # -> simplify(Text)
panel_2 = Panel("""G0 
G1 """)
concat_2 = Concatenate(FragmentA=panel_2, FragmentB=format)
concat_3 = Concatenate(FragmentA=format_3, FragmentB=panel)
merge_2 = Merge(Data2=graft(concat_2), Data3=graft(format_2), Data4=graft(concat_3))
join = TextJoin(Text=merge_2, Join=" ")  # -> simplify(Result)
lng = ListLength(List=explode.Vertices)  # -> flatten(Length)
partition = PartitionList(List=simplify(flatten(join)), Size=lng)  # -> simplify(Chunks)
C_2 = ClusterOutput(partition)
i = ClusterOutput(item)

# ==== cluster Cluster_10
number_slider = Slider(3, range=0..10)
crv = ClusterInput()
D = ClusterInput()
d = ClusterInput()
x0 = ClusterInput()
y0 = ClusterInput()
crv_2 = Curve(crv)
end = EndPoints(Curve=crv_2)  # -> Start, End
darc = DeconstructArc(Arc=crv_2)  # -> BasePlane, Radius, Angle
pdecon = Deconstruct(Point=end.End)  # -> XComponent, YComponent, ZComponent
pdecon_2 = Deconstruct(Point=end.Start)  # -> XComponent, YComponent, ZComponent
pdecon_3 = Deconstruct(Point=darc.BasePlane)  # -> XComponent, YComponent, ZComponent
panel = Panel("""X2 Y2 I J F
I = X(C)-X(1)
J = Y(C)-Y(1)""")
subtraction = Subtraction(A=pdecon.XComponent, X0=x0)
subtraction_2 = Subtraction(A=pdecon.YComponent, Y0=y0)
subtraction_3 = Subtraction(A=pdecon_3.XComponent, B=pdecon_2.XComponent)
subtraction_4 = Subtraction(A=pdecon_3.YComponent, B=pdecon_2.YComponent)
cluster = Cluster_9(C=crv_2, P=darc.BasePlane)
round_to_decimal_place = GhPythonScript(X=subtraction, Y=subtraction_2, Z=pdecon.ZComponent, I=subtraction_3, J=subtraction_4, d=d)  # -> rX, rY, rZ, rI, rJ; inputs X: list, Y: list, Z: list, I: list, J: list, d: Int32; same code as round_to_decimal_place
lng = ListLength(List=cluster)
stack = StackData(Data=D, Stack=lng)  # -> simplify(Data)
format = Format(
    Format="G{0} X{1} Y{2} Z{3} I{4} J{5} F{6}",
    Culture=127,
    Data0=cluster,
    Data1=round_to_decimal_place.rX,
    Data2=round_to_decimal_place.rY,
    Data3=round_to_decimal_place.rZ,
    Data4=round_to_decimal_place.rI,
    Data5=round_to_decimal_place.rJ,
    Data6=stack)
lng_2 = ListLength(List=flatten(crv_2))
bool = Boolean(lng_2)
filter = StreamFilter(Gate=bool, Stream1=format)
s_1 = ClusterOutput(filter)

# ==== cluster Cluster_11
T = ClusterInput()
tstat = TreeStatistics(Tree=T)  # -> Paths, Length, Count
item = ListItem(List=tstat.Paths, Index=0, Wrap=True)
dpath = DeconstructPath(Branch=item)
lng = ListLength(List=dpath)
subtraction = Subtraction(A=lng, B=Slider(2, range=0..2))
neg = Negative(Value=subtraction)
shift = ShiftPaths(Data=T, Offset=neg)  # -> simplify(Data)
panel = Panel(shift)
D = ClusterOutput(shift)

# ==== cluster Connect
A = ClusterInput()
B = ClusterInput()
multiplication = Multiplication(A=A, B=Slider(4, range=0..10))
box_corners = BoxCorners(Box=B)  # -> CornerA, CornerB, CornerC, CornerD, CornerE, CornerF, CornerG, CornerH
pgroups = PointGroups(Points=box_corners.CornerD, Distance=multiplication)  # -> Groups, Indices
shift = ShiftPaths(Data=pgroups.Indices, Offset=-1)
lng = ListLength(List=pgroups.Groups)
item = ListItem(List=B, Index=shift, Wrap=True)
shift_2 = ShiftPaths(Data=lng, Offset=-1)
partition = PartitionList(List=item, Size=shift_2)
area = Area(Geometry=partition)  # -> Area, Centroid
sort = SortList(Keys=area.Area, ValuesA=partition)  # -> Keys, reverse(ValuesA)
split = SplitList(List=sort.ValuesA, Index=1)  # -> ListA, ListB
end = EndPoints(Curve=split.ListA)  # -> Start, End
crv_cp = CurveClosestPoint(Point=end.Start, Curve=split.ListB)  # -> Point, Parameter, Distance
seam = Seam(Curve=split.ListB, Seam=crv_cp.Parameter)
merge = Merge(Data1=simplify(split.ListA), Data2=simplify(seam))
area_2 = Area(Geometry=merge)  # -> Area, Centroid
len = Length(Curve=merge)
sort_2 = SortList(Keys=area_2.Area, ValuesA=merge)  # -> Keys, ValuesA
end_2 = EndPoints(Curve=sort_2.ValuesA)  # -> Start, End
shift_3 = ShiftList(List=end_2.Start, Shift=1, Wrap=True)
ln = Line(StartPoint=end_2.End, EndPoint=shift_3)
cull_i = CullIndex(List=ln, Indices=-1, Wrap=True)
shift_4 = ShiftPaths(Data=cull_i, Offset=-2)
weave = Weave(Pattern=[0, 1], Stream0=sort_2.ValuesA, Stream1=shift_4, NullGaps=False)
break_circles_into_arc_segments = BreakCirclesIntoArcSegments(C=weave)
connect = ConnectCurves(Curves=break_circles_into_arc_segments, Continuity=0, Close=invert(True), Bulge=1)
pltolinearc = PolylineToLinesAndArcs(Curve=connect, Tolerance=0.01)  # -> Polyline, PolyCurve
la = ClusterOutput(pltolinearc.PolyCurve)

# ==== cluster PocketCleanIslands
number_slider = Slider(19, range=0..100)
G = ClusterInput()
D = ClusterInput()
D_2 = ClusterInput()
crv = ClusterInput()
crv_2 = Curve(crv)
shift = ShiftPaths(Data=D, Offset=-1)
Z = UnitZ(Factor=number_slider)
division = Division(A=number_slider, B=2)
tstat = TreeStatistics(Tree=crv_2)  # -> Paths, Length, Count
boundary = BoundarySurfaces(Edges=crv_2)
extr = Extrude(Base=boundary, Direction=Z)
neg = Negative(Value=division)
polyoffset = PolylineOffset(
    Polylines=shift,
    Distance=D_2,
    Plane=Plane(origin=(0, 0, 0), x=(0, 0, 0), y=(0, 0, 0)),
    Tolerance=0.001,
    ClosedFillet=0,
    OpenFillet=1,
    Miter=2)  # -> Contour, Holes
Z_2 = UnitZ(Factor=neg)
cap = CapHoles(Brep=extr)
move = Move(Geometry=cap, Motion=Z_2)  # -> Geometry, Transform
shapein = ShapeInBrep(Brep=move.Geometry, Shape=polyoffset.Holes)
sift = SiftPattern(List=polyoffset.Holes, SiftPattern=shapein)  # -> Output0, Output1, Output2
null = NullItem(Item=sift.Output0)  # -> NullFlags, InvalidFlags, Description
cull = CullPattern(List=sift.Output0, CullPattern=invert(null.NullFlags))
len = Length(Curve=cull)
larger = LargerThan(FirstNumber=len, SecondNumber=Slider(6, range=0..10))  # -> LargerThan, OrEqualTo
cull_2 = CullPattern(List=cull, CullPattern=larger.OrEqualTo)
check_collisions = CheckCollisions(G=graft(crv_2), S=flatten(polyoffset.Holes))
polyoffset_2 = PolylineOffset(
    Polylines=cull_2,
    Distance=Slider(0.1, range=0..1),
    Plane=Plane(origin=(0, 0, 0), x=(0, 0, 0), y=(0, 0, 0)),
    Tolerance=0.001,
    ClosedFillet=0,
    OpenFillet=1,
    Miter=2)  # -> Contour, Holes
len_2 = Length(Curve=check_collisions)
cluster = Cluster_12(C=polyoffset_2.Holes)
larger_2 = LargerThan(FirstNumber=len_2, SecondNumber=Slider(6, range=0..10))  # -> LargerThan, OrEqualTo
shift_2 = ShiftPaths(Data=cluster, Offset=-2)
renumber = RenumberPaths(Data=cluster)
cull_3 = CullPattern(List=check_collisions, CullPattern=larger_2.OrEqualTo)
len_3 = Length(Curve=renumber)
smaller = SmallerThan(FirstNumber=len_3, SecondNumber=1)  # -> SmallerThan, OrEqualTo
filter = StreamFilter(Gate=G, Stream1=cull_3)
cull_4 = CullPattern(List=shift_2, CullPattern=invert(smaller.SmallerThan))
filter_2 = StreamFilter(Gate=G, Stream1=cull_4)
renumber_2 = RenumberPaths(Data=D)
renumber_3 = RenumberPaths(Data=filter)
merge = Merge(Data1=renumber_2, Data2=renumber_3)
R = ClusterOutput(merge)

# ==== cluster Cluster_13
C = ClusterInput()
D = ClusterInput()
topoly = CurveToPolyline(Curve=C, ToleranceDistance=0, ToleranceAngle=0)  # -> Polyline, Segments

# ---- group: BBox
bbox = GhPythonScript(object=topoly.Polyline)  # -> out, box, X, Y, Max, Min
# ---------- bbox: Python ----------
import rhinoscriptsyntax as rs

if object:
    box = rs.BoundingBox(object)
    if box:
        X = rs.Distance(box[0], box[1])
        Y = rs.Distance(box[1], box[2])
        Max = max(X,Y)
        Min = min(X,Y)
# ---------- end bbox ----------

# ----
division = Division(A=bbox.Min, B=D)
division_2 = Division(A=division, B=Slider(1.4, range=0..10))
flatten = FlattenTree(Tree=division_2, Path="{0}")
sort = SortList(Keys=flatten)  # -> reverse(Keys), ValuesA
item = ListItem(List=sort.Keys, Index=0, Wrap=True)
repeat = RepeatData(Data=D, Length=item)  # -> simplify(Data)
ma = MassAddition(Input=repeat)  # -> Result, PartialResults
pr = ClusterOutput(ma.PartialResults)

# ==== cluster PocketOffsetConnection
B = ClusterInput()
A = ClusterInput()
multiplication = Multiplication(A=A, B=Slider(4, range=0..10))
box_corners = BoxCorners(Box=B)  # -> CornerA, CornerB, CornerC, CornerD, CornerE, CornerF, CornerG, CornerH
pgroups = PointGroups(Points=box_corners.CornerA, Distance=multiplication)  # -> Groups, Indices
shift = ShiftPaths(Data=pgroups.Indices, Offset=-1)
lng = ListLength(List=pgroups.Groups)
item = ListItem(List=B, Index=shift, Wrap=True)
shift_2 = ShiftPaths(Data=lng, Offset=-1)
partition = PartitionList(List=item, Size=shift_2)
area = Area(Geometry=partition)  # -> Area, Centroid
sort = SortList(Keys=area.Area, ValuesA=partition)  # -> Keys, reverse(ValuesA)
split = SplitList(List=sort.ValuesA, Index=1)  # -> ListA, ListB
end = EndPoints(Curve=split.ListA)  # -> Start, End
crv_cp = CurveClosestPoint(Point=end.Start, Curve=split.ListB)  # -> Point, Parameter, Distance
seam = Seam(Curve=split.ListB, Seam=crv_cp.Parameter)
merge = Merge(Data1=simplify(split.ListA), Data2=simplify(seam))
area_2 = Area(Geometry=merge)  # -> Area, Centroid
len = Length(Curve=merge)
sort_2 = SortList(Keys=area_2.Area, ValuesA=merge)  # -> Keys, ValuesA
end_2 = EndPoints(Curve=sort_2.ValuesA)  # -> Start, End
shift_3 = ShiftList(List=end_2.Start, Shift=1, Wrap=True)
ln = Line(StartPoint=end_2.End, EndPoint=shift_3)
cull_i = CullIndex(List=ln, Indices=-1, Wrap=True)
shift_4 = ShiftPaths(Data=cull_i, Offset=-2)
weave = Weave(Pattern=[0, 1], Stream0=sort_2.ValuesA, Stream1=shift_4, NullGaps=False)
cluster = Cluster_14(C=weave)
connect = ConnectCurves(Curves=cluster, Continuity=0, Close=invert(True), Bulge=1)
pltolinearc = PolylineToLinesAndArcs(Curve=connect, Tolerance=0.01)  # -> Polyline, PolyCurve
la = ClusterOutput(pltolinearc.PolyCurve)

# ==== cluster Cluster_9
C = ClusterInput()
P = ClusterInput()
side = CurveSide(Curve=C, Point=P)  # -> Side, Left, Right
lng = ListLength(List=side.Left)
stack = StackData(Data="2", Stack=lng)
stack_2 = StackData(Data="3", Stack=lng)
p_n_c = PickNChoose(Pattern=side.Left, Stream0=stack, Stream1=stack_2)
graft = GraftTree(Tree=p_n_c, IncludeEmptyLists=True, IncludeNullItems=True)
R = ClusterOutput(p_n_c)

# ==== cluster BreakCirclesIntoArcSegments
C = ClusterInput()
explode = Explode(Curve=C, Recursive=True)  # -> Segments, Vertices
lng = ListLength(List=explode.Segments)
equals = Equality(FirstNumber=lng, SecondNumber=1)  # -> Equality, Inequality
cls = Closed(Curve=explode.Segments)  # -> Closed, Periodic
and = GateAnd(A=equals.Equality, B=cls.Closed)
dispatch = Dispatch(List=explode.Segments, DispatchPattern=and)  # -> ListA, ListB
divide = DivideCurve(Curve=dispatch.ListA, Count=2, Kinks=False)  # -> Points, Tangents, Parameters
shatter = Shatter(Curve=dispatch.ListA, Parameters=divide.Parameters)  # -> simplify(Segments)
weave = Weave(Pattern=[0, 1], Stream0=shatter, Stream1=dispatch.ListB, NullGaps=False)
shift = ShiftPaths(Data=weave, Offset=-1)
D = ClusterOutput(shift)

# ==== cluster Cluster_12
C = ClusterInput()
explode = Explode(Curve=C, Recursive=True)  # -> Segments, Vertices
python = GhPythonScript(segments=explode.Segments)  # -> out, lines_arcs; same code as python
unweave = Unweave(List=explode.Segments, UnweavePattern=python.lines_arcs)  # -> Data0, Data1
curve_to_arcs_and_lines = CurveToArcsAndLines_2(C=unweave.Data0)
weave = Weave(Pattern=python.lines_arcs, Stream0=curve_to_arcs_and_lines, Stream1=unweave.Data1, NullGaps=False)
connect = ConnectCurves(Curves=weave, Continuity=0, Close=invert(True), Bulge=1)
shift = ShiftPaths(Data=connect, Offset=-1)
D = ClusterOutput(shift)

# ==== cluster CheckCollisions
G = ClusterInput()
S = ClusterInput()
neg = Negative(Value=Slider(10, range=0..100))
Z = UnitZ(Factor=neg)
Z_2 = UnitZ(Factor=Slider(20, range=0..100))
move = Move(Geometry=G, Motion=Z)  # -> Geometry, Transform
boundary = BoundarySurfaces(Edges=move.Geometry)
extr = Extrude(Base=boundary, Direction=Z_2)
cap = CapHoles(Brep=extr)
shapein = ShapeInBrep(Brep=cap, Shape=S)
sift = SiftPattern(List=S, SiftPattern=shapein)  # -> Output0, Output1, Output2
null = NullItem(Item=sift.Output0)  # -> NullFlags, InvalidFlags, Description
cull = CullPattern(List=sift.Output0, CullPattern=invert(null.NullFlags))
L = ClusterOutput(cull)

# ==== cluster Cluster_14
C = ClusterInput()
explode = Explode(Curve=C, Recursive=True)  # -> Segments, Vertices
lng = ListLength(List=explode.Segments)
cls = Closed(Curve=explode.Segments)  # -> Closed, Periodic
equals = Equality(FirstNumber=lng, SecondNumber=1)  # -> Equality, Inequality
and = GateAnd(A=equals.Equality, B=cls.Closed)
dispatch = Dispatch(List=explode.Segments, DispatchPattern=and)  # -> ListA, ListB
divide = DivideCurve(Curve=dispatch.ListA, Count=2, Kinks=False)  # -> Points, Tangents, Parameters
shatter = Shatter(Curve=dispatch.ListA, Parameters=divide.Parameters)  # -> simplify(Segments)
weave = Weave(Pattern=[0, 1], Stream0=shatter, Stream1=dispatch.ListB, NullGaps=False)
shift = ShiftPaths(Data=weave, Offset=-1)
D = ClusterOutput(shift)

# ==== cluster CurveToArcsAndLines_2
C = ClusterInput()
pltolinearc = PolylineToLinesAndArcs(Curve=C, Tolerance=0.01)  # -> Polyline, PolyCurve
end = EndPoints(Curve=C)  # -> Start, End
simplify = SimplifyCurve(Curve=pltolinearc.PolyCurve)  # -> Curve, Simplified
cls = Closed(Curve=pltolinearc.PolyCurve)  # -> Closed, Periodic
dispatch = Dispatch(List=pltolinearc.PolyCurve, DispatchPattern=cls.Closed)  # -> ListA, ListB
dispatch_2 = Dispatch(List=end.Start, DispatchPattern=cls.Closed)  # -> ListA, ListB
crv_cp = CurveClosestPoint(Point=flatten(dispatch_2.ListA), Curve=dispatch.ListA)  # -> Point, Parameter, Distance
sort = SortList(Keys=crv_cp.Distance, ValuesA=crv_cp.Parameter, ValuesB=crv_cp.Point)  # -> Keys, ValuesA, ValuesB
item = ListItem(List=sort.ValuesA, Index=0, Wrap=True)
seam = Seam(Curve=dispatch.ListA, Seam=item)
merge = Merge(Data1=dispatch.ListB, Data2=seam)
R = ClusterOutput(merge)
